# Grasshopper definition Static Responsive grid shells_gh_gt.gh (Grasshopper 1.0.7)
# plug-ins: Karamba, MeshEdit Components, Pufferfish, Anemone, Kangaroo Components, EleFront, LunchBox, Weaverbird, Colibri, Kangaroo2 Components, Wombat

number_slider = Slider(32, range=0..100)
rectangle = Rectangle(Plane=PlaneXY(0, 0, 0), XSize=number_slider, YSize=number_slider, Radius=0)  # -> Rectangle, Length
number_slider_2 = Slider(1, range=0..1)

# ----
# Defining mesh and anchor points
anchor_curves = Curve([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])
free_curves = Curve([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])
curve = Curve([anchor_curves, free_curves])
join_curves = JoinCurves(Curves=curve, Preserve=False)
divide_distance = DivideDistance(Curve=curve, Distance="1")  # -> flatten(Points), Tangents, Parameters
mesh_breps = MeshBreps(
    Brep=join_curves,
    InclusionPoints=divide_distance.Points,
    MeshResolution="1",
    EdgeRefinementFactor=1,
    PointReduction=False,
    SmoothingStepSize=0,
    SmoothingIterations=5)  # -> Mesh, Info
weaverbird_s_naked_boundary = WeaverbirdsNakedBoundary(MeshClosedPolylines=mesh_breps.Mesh)
explode = Explode(Curve=weaverbird_s_naked_boundary, Recursive=True)  # -> Segments, Vertices
offset_curve = OffsetCurve(Curve=anchor_curves, Distance=0.1, Plane=PlaneXY(0, 0, 0), BothSides=True, Kinks=0, CapType=1)
removeduplicatepts = RemoveDuplicatePts(Points=explode.Vertices, Tolerance=0.01)
point_in_curves = PointInCurves(Point=removeduplicatepts, Curves=flatten(offset_curve))  # -> Relationship, Index, Point
cull_pattern = CullPattern(List=point_in_curves.Point, CullPattern=point_in_curves.Relationship)
anchor_points = Point(cull_pattern)
mesh = Mesh(mesh_breps.Mesh)

brep = Brep(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)
circle = Circle(Plane=PlaneXY(0, 0, 0), Radius=Slider(20, range=0..100))
number_slider_3 = Slider(1, range=0..1)

# ----
# form finding of shell surface
anchor_points_2 = Point(anchor_points)
mesh_2 = Mesh(mesh)
weaverbird_s_dual_graph = WeaverbirdsDualGraph(MeshCurves=mesh_2, DualMode=0)
weaverbird_s_mesh_edges = WeaverbirdsMeshEdges(MeshOrPolylines=mesh_2)
deconstruct_mesh = DeconstructMesh(Mesh=mesh_2)  # -> Vertices, Faces, Colours, Normals
area = Area(Geometry=weaverbird_s_dual_graph)  # -> Area, Centroid
unit_z = UnitZ(Factor=area.Area)
closest_point = ClosestPoint(Point=area.Centroid, Cloud=deconstruct_mesh.Vertices)  # -> ClosestPoint, CPIndex, Distance
load = Load(Point=closest_point.ClosestPoint, ForceVector=unit_z)
length_line = LengthLine(Line=weaverbird_s_mesh_edges, Strength=Slider(350, range=0..1000))
anchor = Anchor(Point=anchor_points_2, Strength=Slider(1000000, range=0..1000000))
show = Show(G=mesh_2)
merge = Merge(Data1=show, Data3=length_line, Data4=anchor, Data5=load)
value_list = ValueList({"Point": 0, "Curve": 1, "Arc": 2, "Circle": 3, "Ellipse": 4, "Line": 5, "Polyline": 6, "Surface": 7, "Brep": 8, "Mesh": 9, "Polysurface": 10, "Block": 11, "Text": 12, "TextDot": 13, "Dimension": 14, "LinearDimension": 15, "AngularDimension": 16, "Hatch": 17, "Leader": 18}, selected="Mesh")
zombiesolver = ZombieSolver(GoalObjects=merge, Threshold=1e-10, Tolerance=0.01, MaxIterations=50000)  # -> I, V, flatten(O)
filter_by_type = FilterByType(Geometry=zombiesolver.O, ObjectType=value_list)
clean_tree = CleanTree(RemoveNulls=True, RemoveInvalid=True, RemoveEmpty=False, Tree=filter_by_type)
weaverbird_s_laplacian_smoothing = WeaverbirdsLaplacianSmoothing(MeshCurves=clean_tree, Level=1, SmoothNakedEdges=0, Thin=1)
mesh_3 = Mesh(weaverbird_s_laplacian_smoothing)

loads_karamba = LoadsKaramba(Vector=Vector(0, 0, -1), LCase=0, mode="Gravity")  # -> flatten(Load)
mesh_4 = Mesh(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)
mesh_5 = Mesh(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)
mesh_6 = Mesh(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)
mesh_7 = Mesh(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)
mesh_8 = Mesh(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)
mesh_9 = Mesh(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)
mesh_flip = MeshFlip(Mesh=[mesh_7, mesh_6])
mesh_10 = Mesh(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)
mesh_11 = Mesh(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)
unit_x = UnitX(Factor=Slider(180, range=0..1000))
member_diameter = Slider(22, range=20..23)
alignment = Slider(4, range=0..5, expression="(4^x)-1")
planarity = Slider(4, range=0..4, expression="(10^x)-1")
shell = Slider(2, range=0..2)

# ----
# Defining mesh and anchor points
number_slider_4 = Slider(30, range=0..100)
circle_2 = Circle(Plane=PlaneXY(0, 0, 0), Radius=number_slider_4)
support_length = Slider(5, range=1..20)
support_length_2 = Slider(5, range=1..20)
support_length_3 = Slider(5, range=1..20)
support_length_4 = Slider(5, range=1..20)
support_length_5 = Slider(5, range=1..20)
curve_2 = Curve(circle_2)
point_on_curve = PointOnCurve(curve_2, parameter=0.684)
point_on_curve_2 = PointOnCurve(curve_2, parameter=0.357)
point_on_curve_3 = PointOnCurve(curve_2, parameter=0.726)
point_on_curve_4 = PointOnCurve(curve_2, parameter=0.849)
point_on_curve_5 = PointOnCurve(curve_2, parameter=0)
circle_3 = Circle(
    Plane=[point_on_curve, point_on_curve_2, point_on_curve_5],
    Radius=[support_length_5, support_length_4, support_length_3])
polyline = PolyLine(Vertices=[point_on_curve, point_on_curve_2, point_on_curve_5], Closed=True)
curve_curve = CurveCurve(CurveA=curve_2, CurveB=circle_3)  # -> Points, ParamsA, ParamsB
offset_curve_2 = OffsetCurve(Curve=polyline, Distance=Slider(-0.2, range=-4..5), Plane=PlaneXY(0, 0, 0), Corners=1)
list_length = ListLength(List=circle_3)
multiplication = Multiplication(A=list_length, B=2)
explode_2 = Explode(Curve=offset_curve_2, Recursive=True)  # -> Segments, Vertices
list_item = ListItem(List=curve_curve.Points, Index=0, Wrap=True)
list_item_2 = ListItem(List=curve_curve.Points, Index=1, Wrap=True)
midpoint = Midpoint(Curve=explode_2.Segments)
point = Point(flatten([curve_curve.Points, midpoint]))
ghpython_script = GhPythonScript(x=point)  # -> out, polypts, x, c, tempx; inputs x: list of Point3d
# ---------- ghpython_script: Python ----------
__author__ = "Gautam"
__version__ = "2019.03.11"

import rhinoscriptsyntax as rs
polypts=[]

polypts.append(x[0])
dis=[]
i=0
z=len(x)
while i <(z-1):
    tempx=x[:]
    dist=[]
    del tempx[tempx.index(polypts[i])]
    j=0
    while j <len(tempx):
        dis=rs.Distance(polypts[i],tempx[j])
        dist.append(dis)
        j+=1
    print dist
    if len(dist)>0:
        next=dist.index(min(dist))
        print next
        polypts.append(tempx[next])
    else:
        polypts.append(x[i])
    c=x[x.index(polypts[i])]
    del x[x.index(polypts[i])]

    i+=1
# ---------- end ghpython_script ----------
removeduplicatepts_2 = RemoveDuplicatePts(Points=ghpython_script.polypts, Tolerance=0.01)
line = Line(StartPoint=list_item, EndPoint=list_item_2)
polyline_2 = PolyLine(Vertices=removeduplicatepts_2, Closed=True)
polyline_3 = PolyLine(Vertices=midpoint, Closed=True)
boundary_surfaces = BoundarySurfaces(Edges=polyline_2)
surface_split = SurfaceSplit(Surface=boundary_surfaces, Curves=polyline_3)
curve_3 = Curve(surface_split)
weaverbird_s_catmull_clark_subdivision = WeaverbirdsCatmullClarkSubdivision(MeshCurves=curve_3, Level=2, SmoothNakedEdges=2)
weaverbird_s_constant_quads_split_subdiv = WeaverbirdsConstantQuadsSplitSubdivision(MeshCurves=weaverbird_s_catmull_clark_subdivision, Level=2, SmoothNakedEdges=2)
weaverbird_s_mesh_edges_2 = WeaverbirdsMeshEdges(MeshOrPolylines=weaverbird_s_constant_quads_split_subdiv)
weaverbird_s_naked_boundary_2 = WeaverbirdsNakedBoundary(MeshClosedPolylines=weaverbird_s_constant_quads_split_subdiv)
explode_3 = Explode(Curve=weaverbird_s_naked_boundary_2, Recursive=True)  # -> Segments, Vertices
offset_curve_3 = OffsetCurve(Curve=line, Distance=0.1, Plane=PlaneXY(0, 0, 0), BothSides=True, Kinks=0, CapType=1)
removeduplicatepts_3 = RemoveDuplicatePts(Points=explode_3.Vertices, Tolerance=0.01)
point_in_curves_2 = PointInCurves(Point=removeduplicatepts_3, Curves=flatten(offset_curve_3))  # -> Relationship, Index, Point
cull_pattern_2 = CullPattern(List=point_in_curves_2.Point, CullPattern=point_in_curves_2.Relationship)
anchor_points_3 = Point(cull_pattern_2)

unify_mesh = UnifyMesh(Mesh=weaverbird_s_constant_quads_split_subdiv)  # -> Result, Count

mesh_12 = Mesh(unify_mesh.Result)

# ----
# form finding of shell surface
anchor_points_4 = Point(anchor_points_3)
mesh_13 = Mesh(mesh_12)
weaverbird_s_dual_graph_2 = WeaverbirdsDualGraph(MeshCurves=mesh_13, DualMode=0)
weaverbird_s_mesh_edges_3 = WeaverbirdsMeshEdges(MeshOrPolylines=mesh_13)
deconstruct_mesh_2 = DeconstructMesh(Mesh=mesh_13)  # -> Vertices, Faces, Colours, Normals
area_2 = Area(Geometry=weaverbird_s_dual_graph_2)  # -> Area, Centroid
unit_z_2 = UnitZ(Factor=area_2.Area)
closest_point_2 = ClosestPoint(Point=area_2.Centroid, Cloud=deconstruct_mesh_2.Vertices)  # -> ClosestPoint, CPIndex, Distance
load_2 = Load(Point=closest_point_2.ClosestPoint, ForceVector=unit_z_2)
length_line_2 = LengthLine(Line=weaverbird_s_mesh_edges_3, Strength=Slider(500, range=0..1000))
anchor_2 = Anchor(Point=anchor_points_4, Strength=Slider(1000000, range=0..1000000))
show_2 = Show(G=mesh_13)
merge_2 = Merge(Data1=show_2, Data3=length_line_2, Data4=anchor_2, Data5=load_2)
value_list_2 = ValueList({"Point": 0, "Curve": 1, "Arc": 2, "Circle": 3, "Ellipse": 4, "Line": 5, "Polyline": 6, "Surface": 7, "Brep": 8, "Mesh": 9, "Polysurface": 10, "Block": 11, "Text": 12, "TextDot": 13, "Dimension": 14, "LinearDimension": 15, "AngularDimension": 16, "Hatch": 17, "Leader": 18}, selected="Mesh")
zombiesolver_2 = ZombieSolver(GoalObjects=merge_2, Threshold=1e-10, Tolerance=0.01, MaxIterations=50000)  # -> I, V, flatten(O)
filter_by_type_2 = FilterByType(Geometry=zombiesolver_2.O, ObjectType=value_list_2)
clean_tree_2 = CleanTree(RemoveNulls=True, RemoveInvalid=True, RemoveEmpty=False, Tree=filter_by_type_2)
weaverbird_s_laplacian_smoothing_2 = WeaverbirdsLaplacianSmoothing(MeshCurves=clean_tree_2, Level=3, SmoothNakedEdges=0, Thin=1)

# ----
# Defining mesh and anchor points
md_slider = MDSlider(
    SliderMode=0,
    slider_value=Point(0.5893889199, 0.2328971305, 0.5),
    x_domain=Domain(-1, 1),
    y_domain=Domain(-1, 1),
    z_domain=Domain(0, 1))
multiplication_2 = Multiplication(A=md_slider, B=20)
support_length_6 = Slider(8.8, range=1..20)
point_2 = Point(multiplication_2)
circle_4 = Circle(Plane=point_2, Radius=support_length_6)

divide_distance_2 = DivideDistance(Curve=circle_4, Distance=number_slider_2)  # -> Points, Tangents, Parameters

# ----
# Defining mesh and anchor points
md_slider_2 = MDSlider(
    SliderMode=0,
    slider_value=Point(0.485230689, 0.3685660013, 0.5),
    x_domain=Domain(-1, 1),
    y_domain=Domain(-1, 1),
    z_domain=Domain(0, 1))
multiplication_3 = Multiplication(A=md_slider_2, B=20)
support_length_7 = Slider(5.4, range=1..20)
point_3 = Point(multiplication_3)
brep_2 = Brep(circle)
circle_5 = Circle(Plane=point_3, Radius=support_length_7)

divide_distance_3 = DivideDistance(Curve=circle_5, Distance=number_slider_3)  # -> Points, Tangents, Parameters

mesh_breps_2 = MeshBreps(
    Brep=brep_2,
    InclusionPoints=divide_distance_3.Points,
    MeshResolution=number_slider_3,
    PointReduction=False,
    SmoothingStepSize=0,
    SmoothingIterations=5)  # -> Mesh, Info
weaverbird_s_face_polylines = WeaverbirdsFacePolylines(Mesh=mesh_breps_2.Mesh)
area_3 = Area(Geometry=weaverbird_s_face_polylines)  # -> Area, Centroid
weaverbird_s_naked_boundary_3 = WeaverbirdsNakedBoundary(MeshClosedPolylines=mesh_breps_2.Mesh)
point_in_curves_3 = PointInCurves(Point=area_3.Centroid, Curves=circle_5)  # -> Relationship, Index, Point
item_index_list = ItemIndexList(List=point_in_curves_3.Relationship)
explode_4 = Explode(Curve=weaverbird_s_naked_boundary_3, Recursive=True)  # -> Segments, Vertices
cull_pattern_3 = CullPattern(List=item_index_list, CullPattern=point_in_curves_3.Relationship)
removeduplicatepts_4 = RemoveDuplicatePts(Points=explode_4.Vertices, Tolerance=0.01)
delete_faces = DeleteFaces(Mesh=mesh_breps_2.Mesh, Indices=cull_pattern_3)
anchor_points_5 = Point(divide_distance_3.Points)
mesh_14 = Mesh(delete_faces)

anchor_in_z_direction = Point(removeduplicatepts_4)
anchor_in_z_direction_2 = Point(anchor_in_z_direction)
anchorxyz = AnchorXYZ(Point=anchor_in_z_direction_2, X=True, Y=True, Z=False, Strength=100000)

# ----
# form finding of shell surface
anchor_points_6 = Point(anchor_points_5)
mesh_15 = Mesh(mesh_14)
weaverbird_s_dual_graph_3 = WeaverbirdsDualGraph(MeshCurves=mesh_15, DualMode=0)
weaverbird_s_mesh_edges_4 = WeaverbirdsMeshEdges(MeshOrPolylines=mesh_15)
deconstruct_mesh_3 = DeconstructMesh(Mesh=mesh_15)  # -> Vertices, Faces, Colours, Normals
area_4 = Area(Geometry=weaverbird_s_dual_graph_3)  # -> Area, Centroid
unit_z_3 = UnitZ(Factor=area_4.Area)
closest_point_3 = ClosestPoint(Point=area_4.Centroid, Cloud=deconstruct_mesh_3.Vertices)  # -> ClosestPoint, CPIndex, Distance
load_3 = Load(Point=closest_point_3.ClosestPoint, ForceVector=unit_z_3)
length_line_3 = LengthLine(Line=weaverbird_s_mesh_edges_4, Strength=Slider(50, range=0..1000))
anchor_3 = Anchor(Point=anchor_points_6, Strength=Slider(1000000, range=0..1000000))
show_3 = Show(G=mesh_15)
merge_3 = Merge(Data1=show_3, Data3=length_line_3, Data4=anchor_3, Data5=load_3, Data6=anchorxyz)
value_list_3 = ValueList({"Point": 0, "Curve": 1, "Arc": 2, "Circle": 3, "Ellipse": 4, "Line": 5, "Polyline": 6, "Surface": 7, "Brep": 8, "Mesh": 9, "Polysurface": 10, "Block": 11, "Text": 12, "TextDot": 13, "Dimension": 14, "LinearDimension": 15, "AngularDimension": 16, "Hatch": 17, "Leader": 18}, selected="Mesh")
zombiesolver_3 = ZombieSolver(GoalObjects=merge_3, Threshold=1e-10, Tolerance=0.01, MaxIterations=50000)  # -> I, V, flatten(O)
filter_by_type_3 = FilterByType(Geometry=zombiesolver_3.O, ObjectType=value_list_3)
clean_tree_3 = CleanTree(RemoveNulls=True, RemoveInvalid=True, RemoveEmpty=False, Tree=filter_by_type_3)
weaverbird_s_laplacian_smoothing_3 = WeaverbirdsLaplacianSmoothing(MeshCurves=clean_tree_3, Level=5, SmoothNakedEdges=0, Thin=1)

mesh_breps_3 = MeshBreps(
    Brep=brep,
    InclusionPoints=divide_distance_2.Points,
    MeshResolution=number_slider_2,
    PointReduction=False,
    SmoothingStepSize=0,
    SmoothingIterations=5)  # -> Mesh, Info
weaverbird_s_face_polylines_2 = WeaverbirdsFacePolylines(Mesh=mesh_breps_3.Mesh)
area_5 = Area(Geometry=weaverbird_s_face_polylines_2)  # -> Area, Centroid
point_in_curves_4 = PointInCurves(Point=area_5.Centroid, Curves=circle_4)  # -> Relationship, Index, Point
item_index_list_2 = ItemIndexList(List=point_in_curves_4.Relationship)
cull_pattern_4 = CullPattern(List=item_index_list_2, CullPattern=point_in_curves_4.Relationship)
delete_faces_2 = DeleteFaces(Mesh=mesh_breps_3.Mesh, Indices=cull_pattern_4)
mesh_16 = Mesh(delete_faces_2)

weaverbird_s_naked_boundary_4 = WeaverbirdsNakedBoundary(MeshClosedPolylines=delete_faces_2)
explode_5 = Explode(Curve=weaverbird_s_naked_boundary_4, Recursive=True)  # -> Segments, Vertices
removeduplicatepts_5 = RemoveDuplicatePts(Points=explode_5.Vertices, Tolerance=0.01)

anchor_points_7 = Point(removeduplicatepts_5)

# ----
# form finding of shell surface
anchor_points_8 = Point(anchor_points_7)
mesh_17 = Mesh(mesh_16)
weaverbird_s_dual_graph_4 = WeaverbirdsDualGraph(MeshCurves=mesh_17, DualMode=0)
weaverbird_s_mesh_edges_5 = WeaverbirdsMeshEdges(MeshOrPolylines=mesh_17)
deconstruct_mesh_4 = DeconstructMesh(Mesh=mesh_17)  # -> Vertices, Faces, Colours, Normals
area_6 = Area(Geometry=weaverbird_s_dual_graph_4)  # -> Area, Centroid
unit_z_4 = UnitZ(Factor=area_6.Area)
closest_point_4 = ClosestPoint(Point=area_6.Centroid, Cloud=deconstruct_mesh_4.Vertices)  # -> ClosestPoint, CPIndex, Distance
load_4 = Load(Point=closest_point_4.ClosestPoint, ForceVector=unit_z_4)
length_line_4 = LengthLine(Line=weaverbird_s_mesh_edges_5, Strength=Slider(100, range=0..1000))
anchor_4 = Anchor(Point=anchor_points_8, Strength=Slider(1000000, range=0..1000000))
show_4 = Show(G=mesh_17)
merge_4 = Merge(Data1=show_4, Data3=length_line_4, Data4=anchor_4, Data5=load_4)
value_list_4 = ValueList({"Point": 0, "Curve": 1, "Arc": 2, "Circle": 3, "Ellipse": 4, "Line": 5, "Polyline": 6, "Surface": 7, "Brep": 8, "Mesh": 9, "Polysurface": 10, "Block": 11, "Text": 12, "TextDot": 13, "Dimension": 14, "LinearDimension": 15, "AngularDimension": 16, "Hatch": 17, "Leader": 18}, selected="Mesh")
zombiesolver_4 = ZombieSolver(GoalObjects=merge_4, Threshold=1e-10, Tolerance=0.01, MaxIterations=50000)  # -> I, V, flatten(O)
filter_by_type_4 = FilterByType(Geometry=zombiesolver_4.O, ObjectType=value_list_4)
clean_tree_4 = CleanTree(RemoveNulls=True, RemoveInvalid=True, RemoveEmpty=False, Tree=filter_by_type_4)
weaverbird_s_laplacian_smoothing_4 = WeaverbirdsLaplacianSmoothing(MeshCurves=clean_tree_4, Level=1, SmoothNakedEdges=0, Thin=1)

# ----
# Finite element analysis
mesh_18 = Mesh(mesh_3)
material_selection_karamba = MaterialSelectionKaramba(menu=[dropdown(3), dropdown(1)])
cross_sections_karamba = CrossSectionsKaramba(
    FamilyNameOfCrossSection="DefaultCroSec",
    Material=material_selection_karamba,
    Height_cm=Slider(50, range=0..100),
    mode="Shell - Const")
mesh_to_shell_karamba = MeshToShellKaramba(Mesh=mesh_18, CrossSection=cross_sections_karamba, LimitDistance_m=0.005)  # -> Element, Points, Info
element_karamba = ElementKaramba(flatten(mesh_to_shell_karamba.Element))
load_karamba = LoadKaramba(flatten(loads_karamba))
mesh_19 = Mesh(mesh_18)

weaverbird_s_naked_boundary_5 = WeaverbirdsNakedBoundary(MeshClosedPolylines=mesh_18)
explode_6 = Explode(Curve=weaverbird_s_naked_boundary_5, Recursive=True)  # -> Segments, Vertices
removeduplicatepts_6 = RemoveDuplicatePts(Points=explode_6.Vertices, Tolerance=Slider(0.01, range=0..0.01))
deconstruct = Deconstruct(Point=removeduplicatepts_6)  # -> XComponent, YComponent, ZComponent
expression = Expression(x=deconstruct.ZComponent, Expression="if (x<0.1,1,0)")
cull_pattern_5 = CullPattern(List=removeduplicatepts_6, CullPattern=expression)

support_karamba = SupportKaramba(PosInd=cull_pattern_5, menu=[buttons(on, on, on, on, on, on)])
support_karamba_2 = SupportKaramba(flatten(support_karamba))
assemble_model_karamba = AssembleModelKaramba(
    Points=mesh_to_shell_karamba.Points,
    Elem=element_karamba,
    Support=support_karamba_2,
    Load=load_karamba,
    LimitDistance_m=0.005)  # -> Model, Info, Mass_kg, CenterOfGravity
analyzethi_karamba = AnalyzeThIKaramba(Model=assemble_model_karamba.Model)  # -> CalculatedModel, MaximumDisplacement_m, ResultingForceOfGravity_kN, ElasticEnergy_kNm
panel = Panel(analyzethi_karamba.MaximumDisplacement_m)
model_view_karamba = ModelViewKaramba(Model=analyzethi_karamba.CalculatedModel, LoadCaseFactorsForLinearSuperposition=1, IndexOfVisibleLoadcase=-1)  # -> Model, DeformedMesh, DeformedAxes, DeformedModel
shell_view_karamba = ShellViewKaramba(Model=model_view_karamba.Model, IndexOfLayer=0)  # -> Model, MeshesOfRenderedShells, LegendColors, LegendTags
legend = Legend(Colour=shell_view_karamba.LegendColors, Tags=shell_view_karamba.LegendTags, LegendType=1)
calculated_model = Data(shell_view_karamba.Model)

# ----
# visualize principal stress lines from Karamba
calculated_model_2 = Data(calculated_model)
mesh_20 = Mesh(mesh_19)
populate_geometry = PopulateGeometry(Geometry=mesh_20, Count=Slider(150, range=0..300), Seed=1)
line_results_on_shells_karamba = LineResultsOnShellsKaramba(
    AnalyzedModel=calculated_model_2,
    Layer=Slider(0, range=-1..1),
    ListOfSourcesOfPrincipalStressLinesLinesPoints=populate_geometry,
    SegmentLength_m=0.1,
    DA_deg=90,
    mode="PrincStress")  # -> AnalyzedModel, Lines1, Lines2
custom_preview = CustomPreview(Geometry=line_results_on_shells_karamba.Lines2, Shader=ColourSwatch(SwatchColor=RGB(250, 0, 0)))
custom_preview_2 = CustomPreview(Geometry=line_results_on_shells_karamba.Lines1, Shader=ColourSwatch(SwatchColor=RGB(20, 75, 210)))

# ----
# to extract principal stress Vector field
calculated_model_3 = Data(calculated_model)
result_vectors_on_shells_karamba = ResultVectorsOnShellsKaramba(AnalyzedModel=calculated_model_3, LayerOfResults="0", mode="PrincStress")  # -> AnalyzedModel, Points, FirstPrincipalStressVector_kN_cm2, SecondPrincipalStressVector_kN_cm2, FirstPrincipalStressValue_kN_cm2, SecondPrincipalStressValue_kN_cm2

expression_2 = Expression(x=result_vectors_on_shells_karamba.FirstPrincipalStressValue_kN_cm2, Expression="if (x≠0,1,0)")

cull_pattern_6 = CullPattern(List=result_vectors_on_shells_karamba.Points, CullPattern=expression_2)
cull_pattern_7 = CullPattern(List=result_vectors_on_shells_karamba.SecondPrincipalStressVector_kN_cm2, CullPattern=expression_2)
cull_pattern_8 = CullPattern(List=result_vectors_on_shells_karamba.FirstPrincipalStressVector_kN_cm2, CullPattern=expression_2)
remove_duplicate_points_karamba = RemoveDuplicatePointsKaramba(Point=flatten(cull_pattern_6), LimitDistance=1)  # -> OutPoint, Info, Indexes
cull_index = CullIndex(List=cull_pattern_8, Indices=remove_duplicate_points_karamba.Indexes, Wrap=True)
cull_index_2 = CullIndex(List=cull_pattern_7, Indices=remove_duplicate_points_karamba.Indexes, Wrap=True)
multiplication_4 = Multiplication(A=cull_index, B=Slider(12, range=0..100))
multiplication_5 = Multiplication(A=cull_index_2, B=Slider(12, range=0..100))
move = Move(Geometry=remove_duplicate_points_karamba.OutPoint, Motion=multiplication_4)  # -> Geometry, Transform
move_2 = Move(Geometry=remove_duplicate_points_karamba.OutPoint, Motion=multiplication_5)  # -> Geometry, Transform
line_2 = Line(StartPoint=remove_duplicate_points_karamba.OutPoint, EndPoint=move_2.Geometry)
line_3 = Line(StartPoint=remove_duplicate_points_karamba.OutPoint, EndPoint=move.Geometry)
custom_preview_3 = CustomPreview(Geometry=line_3, Shader=ColourSwatch(SwatchColor=RGB(0, 0, 255)))
custom_preview_4 = CustomPreview(Geometry=line_2, Shader=ColourSwatch(SwatchColor=RGB(255, 0, 0)))
vectorfeildpoints = Point(remove_duplicate_points_karamba.OutPoint)
field_vectorsps1 = Vector(cull_index)
fieldvectorsps2 = Vector(cull_index_2)

# ----
# to extract seed points
mesh_21 = Mesh(mesh_19)
weaverbird_s_naked_boundary_6 = WeaverbirdsNakedBoundary(MeshClosedPolylines=mesh_21)
populate_geometry_2 = PopulateGeometry(Geometry=mesh_21, Count=Slider(300, range=0..300), Seed=1)
populate_geometry_3 = PopulateGeometry(Geometry=mesh_21, Count=Slider(300, range=0..300), Seed=1)
curve_closest_point = CurveClosestPoint(Point=populate_geometry_2, Curve=graft(weaverbird_s_naked_boundary_6))  # -> Point, Parameter, Distance
curve_closest_point_2 = CurveClosestPoint(Point=populate_geometry_3, Curve=graft(weaverbird_s_naked_boundary_6))  # -> Point, Parameter, Distance
mesh_area = MeshArea(Mesh=mesh_21)  # -> Area, Centroid

expression_3 = Expression(x=curve_closest_point.Distance, Expression="if (x>1.5,1,0)")
expression_4 = Expression(x=curve_closest_point_2.Distance, Expression="if (x>1.5,1,0)")
flip_matrix = FlipMatrix(Data=expression_3)
flip_matrix_2 = FlipMatrix(Data=expression_4)
mass_multiplication = MassMultiplication(Input=flip_matrix_2)  # -> flatten(Result), PartialResults
mass_multiplication_2 = MassMultiplication(Input=flip_matrix)  # -> flatten(Result), PartialResults

cull_pattern_9 = CullPattern(List=populate_geometry_3, CullPattern=mass_multiplication.Result)
cull_pattern_10 = CullPattern(List=populate_geometry_2, CullPattern=mass_multiplication_2.Result)
ct2_sort_points_by_reference_point = GhPythonScript(x=cull_pattern_9, y=mesh_area.Centroid)  # -> out, a; inputs x: list of Point3d, y: Point3d
# ---------- ct2_sort_points_by_reference_point: Python ----------
__author__ = "Gautam"
__version__ = "2019.03.16"

import rhinoscriptsyntax as rs
dist=[]

a=[]
for i in range(len(x)):
    dis=rs.Distance(y,x[i])
    dist.append(dis)

newdist=dist[:]
newdist.sort()

for i in range(len(x)):
    a.append(x[dist.index(newdist[i])])
# ---------- end ct2_sort_points_by_reference_point ----------
seedpointsps1 = Point(ct2_sort_points_by_reference_point.a)
seedpointsps2 = Point(cull_pattern_10)

# ----
# to get mesh naked support edges and free edges
mesh_22 = Mesh(mesh_19)
mesh_nakededge = MeshNakedEdge(Mesh=mesh_22)  # -> V, A, B
list_item_3 = ListItem(List=mesh_nakededge.V, Index=mesh_nakededge.B, Wrap=True)
list_item_4 = ListItem(List=mesh_nakededge.V, Index=mesh_nakededge.A, Wrap=True)
line_4 = Line(StartPoint=list_item_4, EndPoint=list_item_3)
join_curves_2 = JoinCurves(Curves=line_4, Preserve=False)  # -> flatten(Curves)
ct1_corner_point_of_support = GhPythonScript(x=list_item_4, y=list_item_3)  # -> out, breakPts; inputs x: list of Point3d, y: list of Point3d
# ---------- ct1_corner_point_of_support: Python ----------
__author__ = "Gautam"
__version__ = "2019.02.21"

import rhinoscriptsyntax as rs
import ghpythonlib.treehelpers as gt
anchor=[]
other=[]
alldis=[]

i=0
breakPts=[]
for i in range(len(x)):
    if x[i][2]<0.05:
        if y[i][2]>0.05:
            breakPts.append(x[i])
    if y[i][2]<0.05:
        if x[i][2]>0.05:
            breakPts.append(y[i])
# ---------- end ct1_corner_point_of_support ----------
point_4 = Point(ct1_corner_point_of_support.breakPts)
meshnakedpolycurves = Curve(join_curves_2)
meshnakedpoints = Point(list_item_4)
mesh_23 = Mesh(mesh_22)

removeduplicatepts_7 = RemoveDuplicatePts(Points=point_4, Tolerance=0.01)

curve_closest_point_3 = CurveClosestPoint(Point=removeduplicatepts_7, Curve=join_curves_2)  # -> Point, Parameter, Distance
shatter = Shatter(Curve=join_curves_2, Parameters=curve_closest_point_3.Parameter)
ghpython_script_2 = GhPythonScript(x=flatten(shatter), y=flatten(join_curves_2))  # -> out, ps1curve, ps2curve; inputs x: list of Curve, y: list of Curve
# ---------- ghpython_script_2: Python ----------
__author__ = "Gautam"
__version__ = "2019.02.25"

import rhinoscriptsyntax as rs
ps1curve=[]
ps2curve=[]
i=0
if len(x)>0:
    s=x[:]
else:
    s=y[:]
for i in range(len(s)):
    z=rs.DivideCurve(s[i],2)
    if z[1][2]<0.1:
        ps1curve.append(s[i])
    else:
        ps2curve.append(s[i])
# ---------- end ghpython_script_2 ----------
meshnakesupportedges = Curve(ghpython_script_2.ps1curve)
meshnakedfreeedges = Curve(ghpython_script_2.ps2curve)

# ----
# Custom Streamline Tracer
number_slider_5 = Slider(2, range=0..3)
ct3_stress_line_generator = GhPythonScript(
    Mesh1=flatten(mesh_23),
    MeshNakedPts=flatten(meshnakedpoints),
    meshNakedEdge=flatten(meshnakedpolycurves),
    meshNakedSupport=flatten(meshnakesupportedges),
    meshNakedOther=flatten(meshnakedfreeedges),
    FieldPts=flatten(vectorfeildpoints),
    FieldVectorsps1=flatten(field_vectorsps1),
    FieldVectorsps2=flatten(fieldvectorsps2),
    StartPtsps1=flatten(seedpointsps1),
    StartPtsps2=flatten(seedpointsps2),
    StepSize=Slider(0.5, range=0.1..2),
    stepMaxAngle=Slider(20, range=0..45),
    linesMinDist=Slider(0.5, range=0.1..2),
    sig=Slider(0.5, range=0..2),
    c=Slider(1000, range=0..1000),
    radius=number_slider_5,
    allowIntersection=Toggle(False),
    allowLooping=Toggle(False),
    allowSingleBoundaryEnds=Toggle(False),
    allowOppositeBoundaryEnds=Toggle(False))  # -> Mesh1, meshNakedOther, meshNakedSupport, streamlinesps1, streamlinesps2; inputs Mesh1: list of Mesh, streamlinesExisting: list, MeshNakedPts: list of Point3d, meshNakedEdge: list of Curve, meshNakedSupport: list of Curve, meshNakedOther: list of Curve, FieldPts: list of Point3d, FieldVectorsps1: list of Vector3d, FieldVectorsps2: list of Vector3d, StartPtsps1: list of Point3d, StartPtsps2: list of Point3d, c: Int32, allowIntersection: Boolean, allowLooping: Boolean, allowSingleBoundaryEnds: Boolean, allowOppositeBoundaryEnds: Boolean
# ---------- ct3_stress_line_generator: Python ----------
__author__ = "Gautam"
__version__ = "2019.01.30"

import rhinoscriptsyntax as rs
import math
import Rhino.Geometry as rg
import ghpythonlib.components as gc
import ghpythonlib.treehelpers as gt

def streamGen(FieldVectors,boundary,boundaryopp,StartPts):
    ############unitizing vector field#########################################
    m=0
    UniVectors=[]
    mne = rs.AddPolyline(MeshNakedPts)
    while m< len(FieldVectors):
        UVector= rs.VectorUnitize(FieldVectors[m])
        UniVectors.append(UVector)
        m+=1
    io=0
    z=0
    streamlines=[]
    pointTrailall=[]

    if streamlinesExisting != None:
        streamlines.extend(streamlinesExisting)
    ###########################################################################

    while z < len(StartPts):
    
    ####to remove start points which are closer than the lineMinDist###########
        ptrail1 = StartPts[z]
        if z>0 and len(streamlines)>0:
            k=0
            actD=[]
            actT=[]
            while k<len(pointTrailall):
                t=rs.PointArrayClosestPoint(pointTrailall[k],ptrail1)
                d= rs.Distance(ptrail1,pointTrailall[k][t])
                actD.append(d)
                minD= actD.index(min(actD))
                k+=1
            if actD[minD]<linesMinDist:
                io+=1
                z+=1
                continue
    ###########################################################################
        i=0
        j=0
        D=[]
        pointTrail1=[]
        pointTrail2=[]
        ptrail1 = StartPts[z] 
        ptrail2 = StartPts[z] 
        pointTrail1.append(ptrail1)
        pointTrail2.append(ptrail2)
        countx1a=0
        countx1b=0
        countx2a=0
        countx2b=0
    
    
    ###############################Principal stress line 1 loop################
        while i<c:
            d1=rs.PointArrayClosestPoint(FieldPts,ptrail1)
            anchor1=ptrail1
            if i<1:
                ptrail1 = rs.CopyObject(ptrail1,(UniVectors[d1]*StepSize))

                a= rs.VectorCreate(ptrail1,pointTrail1[i])
            else:
                a= rs.VectorCreate(pointTrail1[i],pointTrail1[i-1])
                PtsIn=[]
                VecIn=[]
                weight=[]
                f=0
                while f<len(FieldPts):
                    disR=rs.Distance(ptrail1,FieldPts[f])
                    if disR<radius:
                        PtsIn.append(FieldPts[f])
                        VecIn.append(UniVectors[f])
                        weight.append(math.exp(-(disR/sig)))
                    f+=1
                h=0
                ResVecIn1=[]
                while h<len(VecIn):

                    angleIn=rs.VectorAngle(a,VecIn[h])
                    if angleIn<70:
                        ResVecIn1.append(VecIn[h]*weight[h])
                    if angleIn>110:
                        VecIn[h]=rs.VectorReverse(VecIn[h])
                        ResVecIn1.append(VecIn[h]*weight[h])
                    h+=1
                if len(ResVecIn1)<1:
                    ResVecIn1.append(a)
                h=1
                FinVecIn1=ResVecIn1[0]
                while h<len(ResVecIn1):
                    FinVecIn1=rs.VectorAdd(FinVecIn1,ResVecIn1[h])
                    h+=1
    
                FinVec1=rs.VectorUnitize(FinVecIn1)
                UV1=FinVec1
    
                x=pointTrail1[i-1]
                angle1=rs.VectorAngle(a,FinVec1)
    
                if angle1> 80:               #correcting the streamline direction 
                    UV1 =rs.VectorReverse(FinVec1)
                angle1a = rs.VectorAngle(a,UV1)
    
                if angle1a>stepMaxAngle:
                    UV1 = rs.VectorRotate(UV1,-(angle1a-stepMaxAngle),[0,0,1])
    
                angle1b=rs.VectorAngle(a,UV1)
    
                if angle1b>angle1a:
                    UV1=rs.VectorRotate(UV1,2*(angle1a-stepMaxAngle),[0,0,1])
    
                ptrail1 = rs.CopyObject(ptrail1,(UV1*StepSize))

    
    
    
    ############################ line minimum distance################

            latestline=rs.AddLine(pointTrail1[len(pointTrail1)-1],ptrail1)
            counter=0
            for s in range(len(streamlines)):
                if rs.CurveCurveIntersection(latestline,streamlines[s],0.1) !=None:
                    counter+=1

            if counter>0:
                f=-1
                while f<13:
                    counter=0
                    UV1new=rs.VectorRotate(UV1,5*f,[0,0,1])
                    ptrail1=rs.CopyObject(pointTrail1[len(pointTrail1)-1],(UV1new*StepSize))
                    latestline=rs.AddLine(pointTrail1[len(pointTrail1)-1],rs.MeshClosestPoint(Mesh1[0],ptrail1)[0])
                    for t in range(len(streamlines)):
                        if rs.CurveCurveIntersection(latestline,streamlines[t],0.1) !=None:
                            counter+=1
                    if counter<1:

                        UV1=UV1new
                        break
                    if 0>f>-13:
                        f-=1
                    if f<-12:
                        f=0
                    if f>-1:
                        f+=1
            if counter>0:


                ptrail1=rs.CopyObject(pointTrail1[len(pointTrail1)-1],(UV1*StepSize))
                

    
    
    ##############################
            projectpoint1=rs.ProjectPointToMesh(ptrail1,Mesh1,(0,0,1))
            
            if len(projectpoint1)>0:
                finalpoint1=rs.MeshClosestPoint(Mesh1[0],ptrail1)
                ptrail1=finalpoint1[0]
                bothTrail=pointTrail1[:]
                bothTrail.extend(pointTrail2)

                for w in range(len(pointTrail1)):
                    dis= rs.Distance(ptrail1,pointTrail1[w])
                    if dis<((linesMinDist/2)+.02):

                        countx1a+=1
                for w in range(len(pointTrail2)):
                    dis= rs.Distance(ptrail1,pointTrail2[w])
                    if dis<((linesMinDist/2)+.02):
                        countx1b+=1

                if (countx1a>0 or countx1b>0) and allowLooping==True:
                    break
                
                pointTrail1.append(ptrail1)
            else:
                i+=1000
            i+=1
    #######################################################
    
    
    ####################Last point on the pointtrail1 on mesh boundary###########

        if len(pointTrail1)>1 and len(projectpoint1)<1:
            lastline=rs.AddLine(pointTrail1[len(pointTrail1)-1],ptrail1)
            for q in range(len(meshNakedEdge)):
                interlast=rs.CurveCurveIntersection(meshNakedEdge[q],lastline,.5)
                if interlast!= None:
                    lastPt=interlast[0][1]
                    del pointTrail1[len(pointTrail1)-1]
            lastDis=rs.Distance(pointTrail1[len(pointTrail1)-1],lastPt)
            if lastDis<((StepSize/2)-.2):
                del pointTrail1[len(pointTrail1)-1]
            pointTrail1.append(lastPt)
    
    
    
        lastDis=rs.Distance(pointTrail1[len(pointTrail1)-1],pointTrail1[len(pointTrail1)-2])

    ####################
    
    ############################################pointtrail2 loop############################
        while j<c:
            d2=rs.PointArrayClosestPoint(FieldPts,ptrail2)
            anchor2=ptrail2
    
            if j==0:
                ptrail2= rs.CopyObject(ptrail2,(UniVectors[d2]*StepSize*(-1)))
                projectpoint2=rs.ProjectPointToMesh(ptrail2,Mesh1,(0,0,1))

                if len(projectpoint2)>0:
                    ptrail2=projectpoint2[0]
                b= rs.VectorCreate(ptrail2,pointTrail2[j])
            else:
                b= rs.VectorCreate(pointTrail2[j],pointTrail2[j-1])

                PtsIn=[]
                VecIn=[]
                weight=[]
                f=0
                while f<len(FieldPts):
                    disR=rs.Distance(ptrail2,FieldPts[f])
                    if disR<radius:
                        PtsIn.append(FieldPts[f])
                        VecIn.append(UniVectors[f])
                        weight.append(math.exp(-(disR/sig)))
                    f+=1
                h=0
                ResVecIn=[]
                while h<len(VecIn):
                    angleIn=rs.VectorAngle(b,VecIn[h])
                    if angleIn<70:
                        ResVecIn.append(VecIn[h]*weight[h])
                    if angleIn>110:
                        VecIn[h]=rs.VectorReverse(VecIn[h])
                        ResVecIn.append(VecIn[h]*weight[h])
                    h+=1
                h=1
                if len(ResVecIn)<1:
                    ResVecIn.append(b)
                FinVecIn=ResVecIn[0]
                while h<len(ResVecIn):
                    FinVecIn=rs.VectorAdd(FinVecIn,ResVecIn[h])
                    h+=1
    
                FinVec=rs.VectorUnitize(FinVecIn)
                UV2=FinVec
    
    
                y=pointTrail2[j-1]
                angle2=rs.VectorAngle(b,FinVec)
    
    
                if angle2>80:
                    UV2 = rs.VectorReverse(FinVec)
                angle2a = rs.VectorAngle(b,UV2)
    
                if angle2a>stepMaxAngle:
                    UV2 = rs.VectorRotate(UV2,-(angle2a-stepMaxAngle),[0,0,1])
                angle2b=rs.VectorAngle(b,UV2)
    
                if angle2b>angle2a:
                    UV2=rs.VectorRotate(UV2,2*(angle2a-stepMaxAngle),[0,0,1])
    
                ptrail2= rs.CopyObject(ptrail2,(UV2*StepSize))

    
    ####################for min distance between streamlines###############

            latestline=rs.AddLine(pointTrail2[len(pointTrail2)-1],ptrail2)
            counter=0
            for s in range(len(streamlines)):
                if rs.CurveCurveIntersection(latestline,streamlines[s],0.1) !=None:
                    counter+=1
            
            if counter>0:
                f=-1
                while f<13:
                    counter=0
                    UV2new=rs.VectorRotate(UV2,5*f,[0,0,1])
                    ptrail2=rs.CopyObject(pointTrail2[len(pointTrail2)-1],(UV2new*StepSize))

                    latestline=rs.AddLine(pointTrail2[len(pointTrail2)-1],rs.MeshClosestPoint(Mesh1[0],ptrail2)[0])
                    for t in range(len(streamlines)):
                        if rs.CurveCurveIntersection(latestline,streamlines[t],0.1) !=None:
                            counter+=1


                    if counter<1:

                        UV2=UV2new
                        break
                    if 0>f>-13:
                        f-=1
                    if f<-12:
                        f=0
                    if f>-1:
                        f+=1
            if counter>0:
                ptrail2=rs.CopyObject(pointTrail2[len(pointTrail2)-1],(UV2*StepSize))
                
    
            projectpoint2=rs.ProjectPointToMesh(ptrail2,Mesh1,(0,0,1))
            if len(projectpoint2)>0:
                finalpoint2=rs.MeshClosestPoint(Mesh1[0],ptrail2)
                ptrail2=finalpoint2[0]
                bothTrail=pointTrail2[:]
                bothTrail.extend(pointTrail1)
                dist2=[]
                for w in range(len(pointTrail2)):
                    dis= rs.Distance(ptrail2,pointTrail2[w])
                    if dis<((linesMinDist/2)+.02):
                        countx2a+=1

                for w in range(len(pointTrail1)):
                    dis= rs.Distance(ptrail2,pointTrail1[w])
                    if dis<((linesMinDist/2)+.02):
                        countx2b+=1

                if (countx2a>0 or countx2b>0) and allowLooping==True:
                    break


                pointTrail2.append(ptrail2)
            else:
                j+=1000
            j+=1
    ####################################################################
    
    
    
    
    ##############Last point on the pointtrail2 on mesh boundary##########
        if len(pointTrail2)>1 and len(projectpoint2)<1:
            lastline=rs.AddLine(pointTrail2[len(pointTrail2)-1],ptrail2)
            for q in range(len(meshNakedEdge)):
                interlast=rs.CurveCurveIntersection(meshNakedEdge[q],lastline,.5)
                if interlast!= None:
                    lastPt=interlast[0][1]

            
            lastDis=rs.Distance(pointTrail2[len(pointTrail2)-1],lastPt)
            if lastDis<((StepSize/2)-.2):
                del pointTrail2[len(pointTrail2)-1]
            pointTrail2.append(lastPt)

        if allowLooping==True:
            if countx1a>0:
                if len(pointTrail1)>0:
                    temppointTrail1=pointTrail1[:]
                    del temppointTrail1[(len(pointTrail1)-4):(len(pointTrail1))]
                    last2=rs.PointArrayClosestPoint(temppointTrail1,pointTrail1[len(pointTrail1)-1])
                    del pointTrail1[0:last2]
                    del pointTrail2[0:len(pointTrail2)]
    
    
            if countx1b>0:
                if len(pointTrail1)>0:
                    last2=rs.PointArrayClosestPoint(pointTrail2,pointTrail1[len(pointTrail1)-1])
                    del pointTrail2[last2:len(pointTrail2)]
    
            if countx2a>0:
                if len(pointTrail2)>0:
                    temppointTrail2=pointTrail2[:]
                    del temppointTrail2[(len(pointTrail2)-4):(len(pointTrail2))]
                    last1=rs.PointArrayClosestPoint(temppointTrail2,pointTrail2[len(pointTrail2)-1])
                    del pointTrail2[0:last1]
                    del pointTrail1[0:len(pointTrail1)]
    
    
            if countx2b>0:
                if len(pointTrail2)>0:
                    last1=rs.PointArrayClosestPoint(pointTrail1,pointTrail2[len(pointTrail2)-1])
                    del pointTrail1[last1:len(pointTrail1)]

    #########################################################################################





        pointTrail=pointTrail2[:]
        list.reverse(pointTrail)
        if len(pointTrail)>0:
            del pointTrail[(len(pointTrail)-1)]
        if len(pointTrail)>0:
            pointTrail.extend(pointTrail1)
            streamline = rs.AddPolyline(pointTrail)
            if rs.Distance(pointTrail[0],pointTrail[len(pointTrail)-1])<(StepSize*2) and (countx1a>0 or countx1b>0 or countx2a or countx2b ):
                streamline=rs.CloseCurve(streamline,(StepSize*2))
            if streamline!=None:
                count=0
                badloop=0
                countboundcorrect=0
                countbounddouble=0
                looping=0
                freecurve=0
                if countx1a>0 or countx1b>0 or countx2a or countx2b:
                    explodelines=rs.ExplodeCurves(streamline)
                    rogueangle=rs.Angle2(explodelines[0],explodelines[len(explodelines)-2])
                    print rogueangle[0]
                    if rogueangle[0]>120:
                        badloop+=1
                if len(streamlines)>0:
                    for r in range(len(streamlines)):
                        inter=rs.CurveCurveIntersection(streamline,streamlines[r],0.1)
                        if inter!=None:
                            count+=1
                for e in range(len(boundary)):
                    boundarycorrect=rs.CurveCurveIntersection(streamline,boundary[e],0.02)
                    if boundarycorrect!=None:
                        countboundcorrect+=1
                for e in range(len(boundaryopp)):
                    doubleboundary=rs.CurveCurveIntersection(streamline,boundaryopp[e],0.02)
                    if doubleboundary!=None:
                        if len(doubleboundary)>1:
                            countbounddouble+=1
                forfreecurve=0
                for n in range(len(meshNakedEdge)):
                    if rs.CurveCurveIntersection(streamline,meshNakedEdge[n],0.02)==None:
                        forfreecurve+=1
                    if rs.IsCurveClosed(streamline)==False and forfreecurve>(len(meshNakedEdge)-1):
                        freecurve+=1
                if (count<1 or allowIntersection==True) and (countboundcorrect<1 or allowOppositeBoundaryEnds==True) and freecurve<1 and badloop<1 and (countbounddouble<1 or allowSingleBoundaryEnds==True):
                    pointTrailall.append(pointTrail)
                    streamlines.append(streamline)

        z+=1

    ########################################################################################

    ptree=gt.list_to_tree(pointTrailall)
    return (streamlines)

streamlinesps1=streamGen(FieldVectorsps1,meshNakedSupport,meshNakedOther,StartPtsps1)[:]
streamlinesps2=streamGen(FieldVectorsps2,meshNakedOther,meshNakedSupport,StartPtsps2)[:]
# ---------- end ct3_stress_line_generator ----------

# ----
# Subdividing naked curves
nakedsupportcurves = Curve(ct3_stress_line_generator.meshNakedSupport)
nakedfreecurves = Curve(ct3_stress_line_generator.meshNakedOther)
ct4_corner_point = GhPythonScript(x=nakedfreecurves)  # -> out, lines, simplify(shatterPoints), points; inputs x: list of Curve
# ---------- ct4_corner_point: Python ----------
__author__ = "Gautam"
__version__ = "2019.05.15"

import rhinoscriptsyntax as rs
import ghpythonlib.treehelpers as gt
sP=[]
for i in range(1):#(len(x)):
    points=[]
    lines=rs.ExplodeCurves(x[i])
    for j in range(len(lines)-1):
        if rs.Angle2(lines[j],lines[j+1])[0]>20:
            points.append(rs.CurveCurveIntersection(lines[j],lines[j+1],.5)[0][1])
    print rs.Angle2(lines[0],lines[len(lines)-1])[0]
    if rs.Angle2(lines[0],lines[len(lines)-1])[0]>20:
            points.append(rs.CurveCurveIntersection(lines[0],lines[len(lines)-1],.5)[0][1])
sP.append(points)
shatterPoints=gt.list_to_tree(sP)
# ---------- end ct4_corner_point ----------
ct4_corner_point_2 = GhPythonScript(x=nakedsupportcurves)  # -> out, lines, simplify(shatterPoints), points; inputs x: list of Curve; same code as ct4_corner_point
curve_closest_point_4 = CurveClosestPoint(Point=ct4_corner_point_2.shatterPoints, Curve=graft(nakedfreecurves))  # -> Point, Parameter, Distance
curve_closest_point_5 = CurveClosestPoint(Point=ct4_corner_point.shatterPoints, Curve=graft(nakedfreecurves))  # -> Point, Parameter, Distance
shatter_2 = Shatter(Curve=nakedsupportcurves, Parameters=curve_closest_point_4.Parameter)
shatter_3 = Shatter(Curve=nakedfreecurves, Parameters=curve_closest_point_5.Parameter)
ct5_if_x_isnull_return_y = GhPythonScript(x=shatter_3, y=nakedfreecurves)  # -> out, a; inputs x: list of Curve, y: list of Curve
# ---------- ct5_if_x_isnull_return_y: Python ----------
__author__ = "Gautam"
__version__ = "2019.05.15"

import rhinoscriptsyntax as rs
a=x
if len(x)<1:
    a=y
# ---------- end ct5_if_x_isnull_return_y ----------
ct5_if_x_is_null_return_y = GhPythonScript(x=shatter_2, y=nakedsupportcurves)  # -> out, a; inputs x: list of Curve, y: list of Curve; same code as ct5_if_x_isnull_return_y
nakedsupportcurves_2 = Curve(ct5_if_x_is_null_return_y.a)
nakedfreecurves_2 = Curve(ct5_if_x_isnull_return_y.a)

# ----
# Varying density of grid
nakedsupportcurves_3 = Curve(nakedsupportcurves_2)
nakedfreecurves_3 = Curve(nakedfreecurves_2)
mesh_24 = Mesh(ct3_stress_line_generator.Mesh1)
curve_4 = Curve(ct3_stress_line_generator.streamlinesps1)
curve_5 = Curve(ct3_stress_line_generator.streamlinesps2)
loop_start = LoopStart(Repeat=Slider(10, range=0..10), Trigger=Button(), Data=Slider(0, range=-0.5..3), D1=curve_4, D2=curve_5)  # -> port, Counter, Data, Data_2, Data_3
midpoint_2 = Midpoint(Curve=loop_start.Data_2)
midpoint_3 = Midpoint(Curve=loop_start.Data_3)
addition = Addition(A=loop_start.Data, B=Slider(0.2, range=0..1))
remove_duplicate_points_karamba_2 = RemoveDuplicatePointsKaramba(Point=midpoint_3, LimitDistance=addition)  # -> OutPoint, Info, Indexes
remove_duplicate_points_karamba_3 = RemoveDuplicatePointsKaramba(Point=midpoint_2, LimitDistance=addition)  # -> OutPoint, Info, Indexes
cull_index_3 = CullIndex(List=loop_start.Data_3, Indices=remove_duplicate_points_karamba_2.Indexes, Wrap=True)
cull_index_4 = CullIndex(List=loop_start.Data_2, Indices=remove_duplicate_points_karamba_3.Indexes, Wrap=True)
loop_end = LoopEnd(
    port=loop_start.port,
    Exit=False,
    Data=addition,
    Data_2=flatten(cull_index_4),
    Data_3=flatten(cull_index_3),
    TimeOutVal=0,
    pausedState=False,
    state="Last & Record")  # -> Data, D1, D2
nakedsupportcurves_4 = Curve(nakedsupportcurves_3)
nakedfreecurves_4 = Curve(nakedfreecurves_3)
mesh_25 = Mesh(mesh_24)

# ----
# Finding intersection points and
#  joining them to make polylines
nakedfreecurves_5 = Curve(nakedfreecurves_4)
nakedsupportcurves_5 = Curve(nakedsupportcurves_4)
mesh_26 = Mesh(flatten(mesh_25))
weaverbird_s_naked_boundary_7 = WeaverbirdsNakedBoundary(MeshClosedPolylines=mesh_26)
nakedsupportcurves_6 = Curve(nakedsupportcurves_5)
nakedfreecurves_6 = Curve(nakedfreecurves_5)
mesh_27 = Mesh(mesh_26)

# ----
# Homogenisation of grid
nakedsupportcurves_7 = Curve(nakedsupportcurves_6)
nakedfreecurves_7 = Curve(nakedfreecurves_6)
mesh_28 = Mesh(flatten(mesh_27))
curve_6 = Curve([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])
curve_7 = Curve([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])
curve_8 = Curve([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])
curve_9 = Curve([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])
curve_10 = Curve(flatten([nakedfreecurves_7, nakedsupportcurves_7]))
x = Slider(3, range=0..10, expression="10^x")
x_2 = Slider(2, range=0..10, expression="10^x")
x_3 = Slider(5, range=0..10, expression="10^x")
x_4 = Slider(4, range=0..10, expression="10^x")
x_5 = Slider(6, range=0..10, expression="10^x")
x_6 = Slider(50, range=0..1000)
value_list_5 = ValueList({"Point": 0, "Curve": 1, "Arc": 2, "Circle": 3, "Ellipse": 4, "Line": 5, "Polyline": 6, "Surface": 7, "Brep": 8, "Mesh": 9, "Polysurface": 10, "Block": 11, "Text": 12, "TextDot": 13, "Dimension": 14, "LinearDimension": 15, "AngularDimension": 16, "Hatch": 17, "Leader": 18}, selected="Line")
nakedsupportcurves_8 = Curve(nakedsupportcurves_7)
nakedfreecurves_8 = Curve(nakedfreecurves_7)
mesh_29 = Mesh(mesh_28)

# ----
# Manual
# correction
# or
curve_11 = Curve([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])
removeduplicatelines = RemoveDuplicateLines(Lines=curve_8, Tolerance=0.01)

# ----
# Alignment with principal stress directions
nakedsupportcurves_9 = Curve(nakedsupportcurves_8)
mesh_30 = Mesh(mesh_29)
nakedfreecurves_9 = Curve(nakedfreecurves_8)
curve_12 = Curve(flatten([nakedfreecurves_9, nakedsupportcurves_9]))
x_7 = Slider(6, range=0..10, expression="10^x")
x_8 = Slider(4, range=0..10, expression="10^x")
x_9 = Slider(2, range=0..10, expression="10^x")
x_10 = Slider(5, range=0..10, expression="10^x")
x_11 = Slider(4, range=0..10, expression="10^x")
value_list_6 = ValueList({"Point": 0, "Curve": 1, "Arc": 2, "Circle": 3, "Ellipse": 4, "Line": 5, "Polyline": 6, "Surface": 7, "Brep": 8, "Mesh": 9, "Polysurface": 10, "Block": 11, "Text": 12, "TextDot": 13, "Dimension": 14, "LinearDimension": 15, "AngularDimension": 16, "Hatch": 17, "Leader": 18}, selected="Line")

# ----
# smoothing
x_12 = Slider(0, range=0..1000, expression="x*10")
x_13 = Slider(50, range=0..1000, expression="x*10")
x_14 = Slider(4, range=0..10, expression="10^x")
x_15 = Slider(4, range=0..10, expression="10^x")
x_16 = Slider(6, range=0..10, expression="10^x")
value_list_7 = ValueList({"Point": 0, "Curve": 1, "Arc": 2, "Circle": 3, "Ellipse": 4, "Line": 5, "Polyline": 6, "Surface": 7, "Brep": 8, "Mesh": 9, "Polysurface": 10, "Block": 11, "Text": 12, "TextDot": 13, "Dimension": 14, "LinearDimension": 15, "AngularDimension": 16, "Hatch": 17, "Leader": 18}, selected="Mesh")

# ----
# Planarity
x_17 = Slider(12, range=0..12, expression="10^x")
x_18 = Slider(50, range=0..1000, expression="x*10")
x_19 = Slider(6, range=0..10, expression="10^x")
x_20 = Slider(2, range=0..10, expression="10^x")
value_list_8 = ValueList({"Point": 0, "Curve": 1, "Arc": 2, "Circle": 3, "Ellipse": 4, "Line": 5, "Polyline": 6, "Surface": 7, "Brep": 8, "Mesh": 9, "Polysurface": 10, "Block": 11, "Text": 12, "TextDot": 13, "Dimension": 14, "LinearDimension": 15, "AngularDimension": 16, "Hatch": 17, "Leader": 18}, selected="Mesh")

# ----
# Finite element analysis
wind_load = Panel("-0.5")
snow_load = Panel("-0.7")
safety_factor = Panel("1.5")
glass_panels_load = Panel("-0.5")
safety_factor_2 = Panel("1.5")
safety_factor_3 = Panel("-1.3")
safety_factor_4 = Panel("1.3")
multiplication_6 = Multiplication(A=wind_load, B=safety_factor)
multiplication_7 = Multiplication(A=snow_load, B=safety_factor_2)
multiplication_8 = Multiplication(A=glass_panels_load, B=safety_factor_4)
material_selection_karamba_2 = MaterialSelectionKaramba(menu=[dropdown(3), dropdown(1)])
unit_z_5 = UnitZ(Factor=multiplication_6)
unit_y = UnitY(Factor=multiplication_6)
unit_x_2 = UnitX(Factor=multiplication_6)
unit_z_6 = UnitZ(Factor=safety_factor_3)
unit_z_7 = UnitZ(Factor=multiplication_7)
unit_z_8 = UnitZ(Factor=multiplication_8)
loads_karamba_2 = LoadsKaramba(Vector=unit_z_6, LCase=0, mode="Gravity")  # -> flatten(Load)
cross_sections_karamba_2 = CrossSectionsKaramba(
    FamilyNameOfCrossSection="DefaultCroSec",
    Material=material_selection_karamba_2,
    Height_cm=Slider(50, range=0..100),
    mode="Shell - Const")

# ----
# Structural Analysis
member_diameter_2 = Number(Slider(14, range=10..25))
material_selection_karamba_3 = MaterialSelectionKaramba(menu=[dropdown(1), dropdown(1)])
wind_load_2 = Panel("0.5")
snow_load_2 = Panel("-0.7")
glass_panels_load_2 = Panel("-0.5")
safety_factor_5 = Panel("1.5")
safety_factor_6 = Panel("1.5")
safety_factor_7 = Panel("-1.3")
safety_factor_8 = Panel("1.3")
cross_sections_karamba_3 = CrossSectionsKaramba(
    FamilyNameOfCrossSection="DefaultCroSec",
    Material=material_selection_karamba_3,
    Diameter_cm=member_diameter_2,
    WallThickness_cm=Slider(1, range=0..1),
    mode="Circular Hollow")
multiplication_9 = Multiplication(A=snow_load_2, B=safety_factor_5)
multiplication_10 = Multiplication(A=glass_panels_load_2, B=safety_factor_8)
unit_z_9 = UnitZ(Factor=safety_factor_7)
unit_z_10 = UnitZ(Factor=multiplication_9)
unit_z_11 = UnitZ(Factor=multiplication_10)
loads_karamba_3 = LoadsKaramba(Vector=unit_z_9, LCase=0, mode="Gravity")  # -> flatten(Load)
unit_x_3 = UnitX(Factor=Slider(90, range=0..1000))

multiplication_11 = Multiplication(A=member_diameter_2, B=Slider(2, range=0..10))

cross_sections_karamba_4 = CrossSectionsKaramba(
    FamilyNameOfCrossSection="DefaultCroSec",
    Material=material_selection_karamba_3,
    Diameter_cm=multiplication_11,
    WallThickness_cm=Slider(1.5, range=0..2),
    mode="Circular Hollow")

# ----
# Geometry for visualization
division = Division(A=multiplication_11, B=200)  # -> flatten(Result)
division_2 = Division(A=member_diameter_2, B=200)  # -> flatten(Result)

# ----
# Calculating deviation from planarity and visualizing it
number_slider_6 = Slider(-90, range=-90..1000)
unit_x_4 = UnitX(Factor=number_slider_6)

# ----
# visualize principal stress lines from Karamba
number_slider_7 = Slider(300, range=0..300)

# ----
# Creating Design alternatives and storing data
density = Slider(4, range=3..5)
colibri_iterator = ColibriIterator(
    Member_diameter=member_diameter,
    Planarity=planarity,
    Alignment=alignment,
    Density=density,
    RemoteFly=False,
    ignoreAllWarningMsg=False)  # -> Member_diameter, Planarity, Alignment, Density, Value_N, Iteration_Genome
panel_2 = Panel("""Utilization
Displacement
Planarity""")
number_slider_8 = Slider(800, range=0..10000)
panel_3 = Panel(colibri_iterator.Iteration_Genome)
image_setting = ImageSetting(ImageSaveAsName="defaultName", RhinoViewNames=panel_2, Width=number_slider_8, Height=number_slider_8)

density_parameter = Data(colibri_iterator.Density)
tree_branch = TreeBranch(Tree=simplify(loop_end.D1), Path=density_parameter, MaintainPaths=True)  # -> flatten(Branch)
tree_branch_2 = TreeBranch(Tree=simplify(loop_end.D2), Path=density_parameter, MaintainPaths=True)  # -> flatten(Branch)
merge_5 = Merge(Data1=nakedfreecurves_3, Data2=nakedsupportcurves_3, Data3=tree_branch_2, Data4=tree_branch)  # -> flatten(Result)
polylines = Curve(merge_5)

polylines_2 = Curve(polylines)
ct6_intersection_points = GhPythonScript(Mesh1=mesh_26, x=polylines_2)  # -> out, allPtstree; inputs Mesh1: list of Mesh, x: list of Curve
# ---------- ct6_intersection_points: Python ----------
__author__ = "Gautam"
__version__ = "2019.02.27"

import rhinoscriptsyntax as rs
import ghpythonlib.treehelpers as gt
i=0
allPts=[]
allPoly=[]
while i <len(x):
    tempx=x[:]
    del tempx[i]
    b=[]
    j=0
    while j < len(tempx):
        a=rs.CurveCurveIntersection(x[i],tempx[j],0.03)
        if a!= None:
            for q in range(len(a)):
                b.append(a[q][1])
        j+=1
    allPts.append(b)
    del x[i]

allPtstree=gt.list_to_tree(allPts)
# ---------- end ct6_intersection_points ----------
point_5 = Point(simplify(ct6_intersection_points.allPtstree))
clean_tree_5 = CleanTree(RemoveNulls=True, RemoveInvalid=True, RemoveEmpty=True, Tree=point_5)  # -> flatten(Tree)
ct7_making_polyline_along_curves_with_po = GhPythonScript(curves=flatten(polylines_2), points=flatten(clean_tree_5), meshNakedEdge=weaverbird_s_naked_boundary_7)  # -> out, allPoly; "(CT7) Making Polyline along Curves with point Cloud"; inputs curves: list of Curve, points: list of Point3d, meshNakedEdge: list of Curve
# ---------- ct7_making_polyline_along_curves_with_po: Python ----------
__author__ = "Gautam"
__version__ = "2019.03.24"

import rhinoscriptsyntax as rs
allPoly=[]
for i in range(len(curves)):
    a=[]
    params=[]
    c=[]
    for j in range(len(points)):
        closestparam= rs.CurveClosestPoint(curves[i],points[j])
        closest=rs.EvaluateCurve(curves[i],closestparam)
        dis=rs.Distance(closest,points[j])
        if dis<0.05:
            a.append(points[j])
            params.append(closestparam)
    paramsnew=params[:]
    list.sort(paramsnew)
    sortedindex=[]
    for t in range(len(params)):
        index=params.index(paramsnew[t])
        sortedindex.append(index)
    for w in range(len(paramsnew)):
        c.append(a[sortedindex[w]])
    first=c[0]
    poly=rs.AddPolyline(c)
    counter=0

    if rs.IsCurveClosed(curves[i])==True:
        c.append(c[0])
        poly=rs.AddPolyline(c)
#    for p in range(len(meshNakedEdge)):
#        if rs.CurveCurveIntersection(meshNakedEdge[p],poly)==None:
#            counter+=1
#    if counter>len(meshNakedEdge)-1:
#        c.append(c[0])
#        poly=rs.AddPolyline(c)
#    if rs.IsCurveClosed(poly)==False:
#        if rs.Distance(c[0],c[len(c)-1])<(rs.CurveLength(poly)/100):
#            c.append(c[0])
#            poly=rs.AddPolyline(c)

    allPoly.append(poly)
# ---------- end ct7_making_polyline_along_curves_with_po ----------
curve_13 = Curve(ct7_making_polyline_along_curves_with_po.allPoly)
polylines_3 = Curve(curve_13)

alignment_strength = Number(colibri_iterator.Alignment)

# ----
# (Optional) Auto Subdiving
#  polygons into quadrilaterals
polylines_4 = Curve(polylines_3)
explode_7 = Explode(Curve=polylines_4, Recursive=True)  # -> flatten(Segments), flatten(Vertices)
weaverbird_s_mesh_from_lines_weave_back = WeaverbirdsMeshFromLinesWeaveBack(Lines=explode_7.Segments, MaximumValence=4)
weaverbird_s_naked_boundary_8 = WeaverbirdsNakedBoundary(MeshClosedPolylines=weaverbird_s_mesh_from_lines_weave_back)
explode_8 = Explode(Curve=weaverbird_s_naked_boundary_8, Recursive=True)  # -> Segments, Vertices
list_length_2 = ListLength(List=explode_8.Segments)

expression_5 = Expression(x=list_length_2, Expression="if (x<7,1,0)")  # -> flatten(Result)

cull_pattern_11 = CullPattern(List=weaverbird_s_naked_boundary_8, CullPattern=expression_5)
explode_9 = Explode(Curve=cull_pattern_11, Recursive=True)  # -> Segments, Vertices
list_item_5 = ListItem(List=explode_9.Vertices, Index=[0, 3], Wrap=True)
list_item_6 = ListItem(List=list_item_5, Index=1, Wrap=True)
list_item_7 = ListItem(List=list_item_5, Index=0, Wrap=True)
line_5 = Line(StartPoint=list_item_7, EndPoint=list_item_6)  # -> flatten(Line)

addedlines = Curve(line_5)
polylines_5 = Curve(polylines_3)
explode_10 = Explode(Curve=polylines_5, Recursive=True)  # -> flatten(Segments), flatten(Vertices)

curve_14 = Curve([explode_10.Segments, addedlines])

removeduplicatelines_2 = RemoveDuplicateLines(Lines=curve_14, Tolerance=0.005)
curve_15 = Curve(flatten(removeduplicatelines_2))
explode_11 = Explode(Curve=curve_15, Recursive=True)  # -> Segments, flatten(Vertices)
removeduplicatepts_8 = RemoveDuplicatePts(Points=explode_11.Vertices, Tolerance=0.01)
ct7_making_polyline_along_curves_with_po_2 = GhPythonScript(curves=curve_10, points=flatten(removeduplicatepts_8), meshNakedEdge=curve_10)  # -> out, c, allPoly, newline, first; "(CT7) Making Polyline along Curves with point Cloud"; inputs curves: list of Curve, points: list of Point3d, meshNakedEdge: list of Curve
# ---------- ct7_making_polyline_along_curves_with_po_2: Python ----------
__author__ = "Gautam"
__version__ = "2019.03.24"

import rhinoscriptsyntax as rs
allPoly=[]
for i in range(len(curves)):
    a=[]
    params=[]
    c=[]
    for j in range(len(points)):
        closestparam= rs.CurveClosestPoint(curves[i],points[j])
        closest=rs.EvaluateCurve(curves[i],closestparam)
        dis=rs.Distance(closest,points[j])
        if dis<0.04:
            a.append(points[j])
            params.append(closestparam)
    paramsnew=params[:]
    list.sort(paramsnew)
    sortedindex=[]
    for t in range(len(params)):
        index=params.index(paramsnew[t])
        sortedindex.append(index)
    for w in range(len(paramsnew)):
        c.append(a[sortedindex[w]])
    first=c[0]
    poly=rs.AddPolyline(c)
    counter=0
    for p in range(len(meshNakedEdge)):
        if rs.CurveCurveIntersection(meshNakedEdge[p],poly)==None:
            counter+=1
    if counter>len(meshNakedEdge)-1:
        c.append(c[0])
        poly=rs.AddPolyline(c)
    if rs.IsCurveClosed(poly)==False:
        if rs.Distance(c[0],c[len(c)-1])<(rs.CurveLength(poly)/10):
            c.append(c[0])
            poly=rs.AddPolyline(c)

    allPoly.append(poly)
# ---------- end ct7_making_polyline_along_curves_with_po_2 ----------
curve_16 = Curve(flatten(ct7_making_polyline_along_curves_with_po_2.allPoly))
length = Length(Curve=curve_15)
explode_12 = Explode(Curve=curve_16, Recursive=True)  # -> Segments, Vertices
average = Average(Input=length)
removeduplicatepts_9 = RemoveDuplicatePts(Points=explode_12.Vertices, Tolerance=0.01)
multiplication_12 = Multiplication(A=average, B=Slider(4, range=0..10))
ct8_calculating_rest_length = GhPythonScript(lines=flatten(curve_15), radius=multiplication_12)  # -> out, restlen, a, ptsIn; inputs lines: list of Curve
# ---------- ct8_calculating_rest_length: Python ----------
__author__ = "Gautam"
__version__ = "2019.03.04"

import rhinoscriptsyntax as rs
import math as math
linesbrk=[]
lineslen=[]
linesvec=[]
restlen=[]
for i in range(len(lines)):
    linebrk=rs.DivideCurve(lines[i],2)
    linesbrk.append(linebrk)
    linevec=rs.VectorCreate(linebrk[0],linebrk[2])
    linesvec.append(linevec)
    linelen=rs.CurveLength(lines[i])
    lineslen.append(linelen)

for i in range(len(lines)):
#    sph1=rs.AddSphere(linesbrk[i][1],radius)
    linesIn=[]
    ptsIn=[]
    a=lines[i]

    for j in range(len(lines)):
        disR=rs.Distance(linesbrk[i][1],linesbrk[j][1])
        if disR<radius:
            ptsIn.append(linesbrk[j][1])
            angle1=rs.VectorAngle(linesvec[i],linesvec[j])
            if  angle1<35 or angle1>145:
                linesIn.append(lineslen[j])
    rl=sum(linesIn)/(len(linesIn))
    restlen.append(rl)
# ---------- end ct8_calculating_rest_length ----------
curve_17 = Curve(flatten(curve_15))
deconstruct_2 = Deconstruct(Point=flatten(removeduplicatepts_9))  # -> XComponent, YComponent, ZComponent
multiplication_13 = Multiplication(A=average, B=Slider(1.5, range=0..10))
division_3 = Division(A=average, B=Slider(3.5, range=0..10))
explode_13 = Explode(Curve=curve_17, Recursive=True)  # -> Segments, Vertices
data = Data(flatten(ct8_calculating_rest_length.restlen))
list_item_8 = ListItem(List=explode_13.Vertices, Index=0, Wrap=True)
list_item_9 = ListItem(List=explode_13.Vertices, Index=1, Wrap=True)
vector_2pt = Vector2Pt(PointA=list_item_8, PointB=list_item_9, Unitize=True)  # -> flatten(Vector), Length
multiplication_14 = Multiplication(A=data, B=Slider(0.8, range=0.1..1))
length_line_5 = LengthLine(Line=flatten(curve_15), Length=flatten(multiplication_14), Strength=x_2)
direction = Direction(Line=curve_17, Direction=vector_2pt.Vector, Strength=x_6)
clamplength = ClampLength(Line=curve_15, LowerLimit=division_3, UpperLimit=multiplication_13, Strength=x)
oncurve = OnCurve(Points=removeduplicatepts_9, Curve=graft(curve_10), Strength=x_4)
onmesh = OnMesh(Points=removeduplicatepts_8, Mesh=mesh_28, Strength=x_3)
curve_18 = Curve(curve_15)

expression_6 = Expression(x=deconstruct_2.ZComponent, Expression="if (x<0.05,1,0)")

cull_pattern_12 = CullPattern(List=flatten(removeduplicatepts_9), CullPattern=expression_6)
anchorxyz_2 = AnchorXYZ(Point=cull_pattern_12, X=False, Y=False, Z=Toggle(True), Strength=x_5)
merge_6 = Merge(Data1=length_line_5, Data2=onmesh, Data3=oncurve, Data4=clamplength, Data5=direction, Data6=anchorxyz_2)
zombiesolver_5 = ZombieSolver(GoalObjects=merge_6, Threshold=1e-08, Tolerance=0.01, MaxIterations=50000)  # -> I, V, O
clean_tree_6 = CleanTree(RemoveNulls=True, RemoveInvalid=True, RemoveEmpty=True, Tree=zombiesolver_5.O)
filter_by_type_5 = FilterByType(Geometry=clean_tree_6, ObjectType=value_list_5)
clean_tree_7 = CleanTree(RemoveNulls=True, RemoveInvalid=True, RemoveEmpty=True, Tree=filter_by_type_5)
curve_19 = Curve(clean_tree_7)

curve_20 = Curve(curve_18)
curve_21 = Curve(curve_19)
midpoint_4 = Midpoint(Curve=curve_21)
ct9_calculating_alignment_vector = GhPythonScript(x=flatten(curve_20), y=flatten(curve_21), radius=Slider(5, range=1..10))  # -> out, finVecs; inputs x: list of Curve, y: list of Curve, radius: Int32
# ---------- ct9_calculating_alignment_vector: Python ----------
__author__ = "Gautam"
__version__ = "2019.03.23"


midy=[]
midx=[]
vectorsy=[]
vectorsx=[]
finVecs=[]
import rhinoscriptsyntax as rs
for i in range (len(y)):
    pointsy=rs.DivideCurve(y[i],2)
    pointsx=rs.DivideCurve(x[i],2)
    midy.append(pointsy[1])
    midx.append(pointsx[1])
    vecy=rs.VectorCreate(pointsy[0],pointsy[2])
    vecy=rs.VectorUnitize(vecy)
    vecx=rs.VectorCreate(pointsx[0],pointsx[2])
    vecx=rs.VectorUnitize(vecx)
    vectorsy.append(vecy)
    vectorsx.append(vecx)

for i in range(len(y)):
    distance=[]
    ptsIn=[]
    vecIn=[]
    vecInFin=[]
    
    for j in range(len(x)):
        distance=rs.Distance(midy[i],midx[j])
        if distance < radius:
            vecIn.append(vectorsx[j])
    for j in range(len(vecIn)):
        if rs.VectorAngle(vectorsy[i],vecIn[j])>90:
            vecIn[j]=rs.VectorReverse(vecIn[j])
        if rs.VectorAngle(vectorsy[i],vecIn[j])<40:
            vecInFin.append(vecIn[j])
    if len(vecInFin)>0:
        finVec=vectorsy[i]
    k=1
    while k<len(vecInFin):
        finVec=rs.VectorAdd(finVec,vecInFin[k])
        k+=1
    finVec=rs.VectorUnitize(finVec)
    finVecs.append(finVec)
# ---------- end ct9_calculating_alignment_vector ----------
vector_display = VectorDisplay(Anchor=midpoint_4, Vector=ct9_calculating_alignment_vector.finVecs)
explode_14 = Explode(Curve=curve_21, Recursive=True)  # -> flatten(Segments), flatten(Vertices)
length_2 = Length(Curve=curve_21)
removeduplicatepts_10 = RemoveDuplicatePts(Points=explode_14.Vertices, Tolerance=0.01)
ct7_making_polyline_along_curves_with_po_3 = GhPythonScript(curves=curve_12, points=flatten(removeduplicatepts_10), meshNakedEdge=curve_12)  # -> out, c, allPoly, newline, first; "(CT7) Making Polyline along Curves with point Cloud"; inputs curves: list of Curve, points: list of Point3d, meshNakedEdge: list of Curve; same code as ct7_making_polyline_along_curves_with_po_2
multiplication_15 = Multiplication(A=length_2, B=Slider(1, range=0.1..1.1))
curve_22 = Curve(flatten(ct7_making_polyline_along_curves_with_po_3.allPoly))
explode_15 = Explode(Curve=curve_22, Recursive=True)  # -> Segments, Vertices
removeduplicatepts_11 = RemoveDuplicatePts(Points=explode_15.Vertices, Tolerance=0.01)
deconstruct_3 = Deconstruct(Point=flatten(removeduplicatepts_11))  # -> XComponent, YComponent, ZComponent
length_line_6 = LengthLine(Line=flatten(curve_21), Length=flatten(multiplication_15), Strength=x_9)
direction_2 = Direction(Line=curve_21, Direction=ct9_calculating_alignment_vector.finVecs, Strength=alignment_strength)
oncurve_2 = OnCurve(Points=removeduplicatepts_11, Curve=graft(curve_12), Strength=x_11)
onmesh_2 = OnMesh(Points=removeduplicatepts_10, Mesh=mesh_30, Strength=x_10)

length_3 = Length(Curve=curve_21)
maximum = GhPythonScript(x=length_3)  # -> out, maxim, ind; inputs x: list; same code as maximum
maximum_2 = GhPythonScript(x=length_3)  # -> out, minim, ind; inputs x: list; same code as maximum_2
expression_7 = Expression(x=deconstruct_3.ZComponent, Expression="if (x<0.1,1,0)")

multiplication_16 = Multiplication(A=maximum.maxim, B=Slider(1, range=0..10))
division_4 = Division(A=maximum_2.minim, B=Slider(1, range=0..10))
cull_pattern_13 = CullPattern(List=flatten(removeduplicatepts_11), CullPattern=expression_7)
clamplength_2 = ClampLength(Line=curve_21, LowerLimit=division_4, UpperLimit=multiplication_16, Strength=x_8)
anchorxyz_3 = AnchorXYZ(Point=cull_pattern_13, X=False, Y=False, Z=Toggle(True), Strength=x_7)
merge_7 = Merge(Data1=length_line_6, Data3=onmesh_2, Data4=oncurve_2, Data5=clamplength_2, Data6=direction_2, Data7=anchorxyz_3)
zombiesolver_6 = ZombieSolver(GoalObjects=merge_7, Threshold=1e-08, Tolerance=0.01, MaxIterations=50000)  # -> I, V, O
filter_by_type_6 = FilterByType(Geometry=zombiesolver_6.O, ObjectType=value_list_6)
clean_tree_8 = CleanTree(RemoveNulls=True, RemoveInvalid=True, RemoveEmpty=True, Tree=filter_by_type_6)
weaverbird_s_mesh_from_lines_weave_back_2 = WeaverbirdsMeshFromLinesWeaveBack(Lines=clean_tree_8, MaximumValence=10)

mesh_31 = Mesh(weaverbird_s_mesh_from_lines_weave_back_2)
weaverbird_s_naked_boundary_9 = WeaverbirdsNakedBoundary(MeshClosedPolylines=mesh_31)
explode_16 = Explode(Curve=flatten(weaverbird_s_naked_boundary_9), Recursive=True)  # -> Segments, Vertices
deconstruct_4 = Deconstruct(Point=explode_16.Vertices)  # -> XComponent, YComponent, ZComponent
expression_8 = Expression(x=deconstruct_4.ZComponent, Expression="if (x>0.1,0,1)")
weaverbird_s_vertices_component = WeaverbirdsVerticesComponent(MeshClosedPolylinesGroup=mesh_31, Weld=True)  # -> flatten(Points)
weaverbird_s_mesh_edges_6 = WeaverbirdsMeshEdges(MeshOrPolylines=mesh_31)
cull_pattern_14 = CullPattern(List=explode_16.Vertices, CullPattern=expression_8)
curve_23 = Curve(flatten(weaverbird_s_mesh_edges_6))
ct10_adjancent_lines = GhPythonScript(x=weaverbird_s_vertices_component, y=curve_23)  # -> out, lineA, lineB, restAngle; inputs x: list, y: list of Curve
# ---------- ct10_adjancent_lines: Python ----------
__author__ = "Gautam"
__version__ = "2019.05.01"

import rhinoscriptsyntax as rs
import ghpythonlib.treehelpers as gt
b=[]
for i in range(len(x)):
    a=[]
    for j in range(len(y)):
        bool=rs.IsPointOnCurve(y[j],x[i])
        if bool==True:
            a.append(y[j])
    b.append(a)
c=gt.list_to_tree(b)
lineA=[]
lineB=[]
restAngle=[]
for i in range(len(b)):
    l=b[i][:]
    j=0
    if len(l)<5:
        while j < len(l):
            m=l[:]
            del m[j]
            for k in range(len(m)):
                print j
                print k
                angle=rs.Angle2(l[j],m[k])
                if angle[0]<30:
                    print angle
                    lineA.append(l[j])
                    lineB.append(m[k])
                    restAngle.append(0)
                    del l[j]
                if angle[0]>150:
                    print angle
                    lineA.append(l[j])
                    lineB.append(m[k])
                    restAngle.append(3.14)
                    del l[j]
            j+=1
# ---------- end ct10_adjancent_lines ----------
angle = Angle(
    LineA=ct10_adjancent_lines.lineA,
    LineB=ct10_adjancent_lines.lineB,
    RestAngle=ct10_adjancent_lines.restAngle,
    Strength=x_12)
length_line_7 = LengthLine(Line=curve_23, Strength=x_13)
oncurve_3 = OnCurve(Points=explode_16.Vertices, Curve=graft(weaverbird_s_naked_boundary_9), Strength=x_14)
onmesh_3 = OnMesh(Points=weaverbird_s_vertices_component, Mesh=mesh_31, Strength=x_15)
show_5 = Show(G=mesh_31)
anchorxyz_4 = AnchorXYZ(Point=cull_pattern_14, X=False, Y=False, Z=Toggle(True), Strength=x_16)
merge_8 = Merge(Data1=show_5, Data2=length_line_7, Data3=onmesh_3, Data4=oncurve_3, Data5=anchorxyz_4, Data6=angle)
zombiesolver_7 = ZombieSolver(GoalObjects=merge_8, Threshold=1e-06, Tolerance=0.01, MaxIterations=50000)  # -> I, V, O
filter_by_type_7 = FilterByType(Geometry=zombiesolver_7.O, ObjectType=value_list_7)
clean_tree_9 = CleanTree(RemoveNulls=True, RemoveInvalid=True, RemoveEmpty=False, Tree=filter_by_type_7)  # -> flatten(Tree)
list_item_10 = ListItem(List=clean_tree_9, Index=0, Wrap=True)

mesh_32 = Mesh(weaverbird_s_mesh_from_lines_weave_back_2)
mesh_33 = Mesh(flatten([mesh_32, mesh_flip]))

planarity_strength = Number(colibri_iterator.Planarity)

# ----
# Creating Design alternatives and storing data
colibri_iterator_2 = ColibriIterator(shell=shell, RemoteFly=False, ignoreAllWarningMsg=False)  # -> shell, Value_N, Iteration_Genome
panel_4 = Panel("""Utilization
Displacement
Planarity""")
number_slider_9 = Slider(800, range=0..10000)
panel_5 = Panel(colibri_iterator_2.Iteration_Genome)
image_setting_2 = ImageSetting(ImageSaveAsName="defaultName", RhinoViewNames=panel_4, Width=number_slider_9, Height=number_slider_9)

list_item_11 = ListItem(List=mesh_33, Index=colibri_iterator_2.shell, Wrap=True)
panel_6 = Panel(list_item_11)

mesh_34 = Mesh(list_item_11)
weaverbird_s_naked_boundary_10 = WeaverbirdsNakedBoundary(MeshClosedPolylines=mesh_34)
explode_17 = Explode(Curve=weaverbird_s_naked_boundary_10, Recursive=True)  # -> Segments, Vertices
deconstruct_5 = Deconstruct(Point=explode_17.Vertices)  # -> XComponent, YComponent, ZComponent
weaverbird_s_vertices_component_2 = WeaverbirdsVerticesComponent(MeshClosedPolylinesGroup=mesh_34, Weld=True)  # -> flatten(Points)
weaverbird_s_mesh_edges_7 = WeaverbirdsMeshEdges(MeshOrPolylines=mesh_34)  # -> flatten(Lines)
planarize = Planarize(M=mesh_34, Strength=planarity_strength)
length_line_8 = LengthLine(Line=weaverbird_s_mesh_edges_7, Strength=x_18)
oncurve_4 = OnCurve(Points=explode_17.Vertices, Curve=graft(weaverbird_s_naked_boundary_10), Strength=x_19)
onmesh_4 = OnMesh(Points=weaverbird_s_vertices_component_2, Mesh=mesh_34, Strength=x_20)
show_6 = Show(G=mesh_34)

expression_9 = Expression(x=deconstruct_5.ZComponent, Expression="if (x>0.1,0,1)")

cull_pattern_15 = CullPattern(List=explode_17.Vertices, CullPattern=expression_9)
anchor_5 = Anchor(Point=cull_pattern_15, Strength=x_17)
merge_9 = Merge(Data1=show_6, Data2=length_line_8, Data3=onmesh_4, Data4=oncurve_4, Data6=anchor_5, Data7=planarize)
zombiesolver_8 = ZombieSolver(GoalObjects=merge_9, Threshold=1e-10, Tolerance=0.01, MaxIterations=50000)  # -> I, V, O
filter_by_type_8 = FilterByType(Geometry=zombiesolver_8.O, ObjectType=value_list_8)
clean_tree_10 = CleanTree(RemoveNulls=True, RemoveInvalid=True, RemoveEmpty=False, Tree=filter_by_type_8)  # -> flatten(Tree)
list_item_12 = ListItem(List=clean_tree_10, Index=0, Wrap=True)
mesh_35 = Mesh(list_item_12)

mesh_36 = Mesh(mesh_35)
move_3 = Move(Geometry=mesh_36, Motion=unit_x_4)  # -> Geometry, Transform
weaverbird_s_face_polylines_3 = WeaverbirdsFacePolylines(Mesh=move_3.Geometry)
explode_18 = Explode(Curve=weaverbird_s_face_polylines_3, Recursive=True)  # -> Segments, Vertices
removeduplicatepts_12 = RemoveDuplicatePts(Points=explode_18.Vertices, Tolerance=0.01)  # -> simplify(UniquePoints)
panel_7 = Panel(removeduplicatepts_12)
list_item_13 = ListItem(List=panel_7, Index=2, Wrap=True)
list_item_14 = ListItem(List=panel_7, Index=1, Wrap=True)
list_item_15 = ListItem(List=panel_7, Index=3, Wrap=True)
list_item_16 = ListItem(List=panel_7, Index=0, Wrap=True)
_4point_surface = _4PointSurface(CornerA=list_item_16, CornerB=list_item_14, CornerC=list_item_13, CornerD=list_item_15)  # -> flatten(Surface)
flatness_check = FlatnessCheck(PanelList=_4point_surface)  # -> FlatPanels, Planes, Deviations
bounds = Bounds(Numbers=flatness_check.Deviations)
multiplication_17 = Multiplication(A=flatness_check.Deviations, B=1000)
deconstruct_domain² = DeconstructDomain²(Domain=bounds)  # -> UComponent, VComponent
maximum_3 = GhPythonScript(x=multiplication_17)  # -> out, maxim, ind; inputs x: list; same code as maximum
panel_8 = Panel(maximum_3.ind)
planarity_2 = Panel(maximum_3.maxim)
gradient = Gradient(
    LowerLimit=Slider(0.1, range=0..0.1),
    UpperLimit=Slider(0, range=0..0.1),
    Parameter=flatness_check.Deviations,
    stops=[0: RGB(234, 38, 0), 0.25: RGB(234, 126, 0), 0.5: RGB(254, 244, 84), 0.75: RGB(173, 203, 249), 1: RGB(75, 107, 169)])
custom_preview_5 = CustomPreview(Geometry=_4point_surface, Shader=gradient)

# ----
# Calculating number of nodes,
#    beams and unique beams
mesh_37 = Mesh(mesh_35)
weaverbird_s_vertices_component_3 = WeaverbirdsVerticesComponent(MeshClosedPolylinesGroup=mesh_37, Weld=True)
weaverbird_s_mesh_edges_8 = WeaverbirdsMeshEdges(MeshOrPolylines=mesh_37)
length_4 = Length(Curve=weaverbird_s_mesh_edges_8)
removeduplicatepts_13 = RemoveDuplicatePts(Points=weaverbird_s_vertices_component_3, Tolerance=0.01)
round_to_decimal_place = RoundToDecimalPlace(NumberX=length_4, DecimalPlace=2, RoundType=0)  # -> Rounded, Difference
sort_duplicate_values = SortDuplicateValues(ValueList=round_to_decimal_place.Rounded)  # -> UniqueValues, Indices
list_length_3 = ListLength(List=removeduplicatepts_13)
list_length_4 = ListLength(List=weaverbird_s_mesh_edges_8)
list_length_5 = ListLength(List=sort_duplicate_values.UniqueValues)

no_of_unique_beams = Panel(list_length_5)
planarity_deviation_mm = Panel(maximum_3.maxim)
no_of_nodes = Panel(list_length_3)
no_of_beams = Panel(list_length_4)

mesh_38 = Mesh(mesh_35)
weaverbird_s_mesh_edges_9 = WeaverbirdsMeshEdges(MeshOrPolylines=mesh_38)
weaverbird_s_vertices_component_4 = WeaverbirdsVerticesComponent(MeshClosedPolylinesGroup=mesh_38, Weld=True)
divide_curve = DivideCurve(Curve=weaverbird_s_mesh_edges_9, Count=2, Kinks=False)  # -> Points, Tangents, Parameters
midpoint_5 = Midpoint(Curve=weaverbird_s_mesh_edges_9)
removeduplicatepts_14 = RemoveDuplicatePts(Points=weaverbird_s_vertices_component_4, Tolerance=0.01)
deconstruct_6 = Deconstruct(Point=midpoint_5)  # -> XComponent, YComponent, ZComponent
deconstruct_7 = Deconstruct(Point=removeduplicatepts_14)  # -> XComponent, YComponent, ZComponent
mesh_edges = MeshEdges(Mesh=mesh_38)  # -> NakedEdges, InteriorEdges, NonManifoldEdges
calculating_wind_load = CalculatingWindLoad(mesh=mesh_38)
multiplication_18 = Multiplication(A=wind_load_2, B=calculating_wind_load)
multiplication_19 = Multiplication(A=multiplication_18, B=safety_factor_6)
unit_z_12 = UnitZ(Factor=multiplication_19)
loads_karamba_4 = LoadsKaramba(
    Vector=unit_z_11,
    Mesh=mesh_38,
    BeamIdentifiers="A",
    LCase=0,
    mode="MeshLoad -Const.",
    menu=[buttons(off, on, off), buttons(on, off)])  # -> flatten(Load)
loads_karamba_5 = LoadsKaramba(
    Vector=unit_z_10,
    Mesh=mesh_38,
    BeamIdentifiers="A",
    LCase=0,
    mode="MeshLoad -Const.",
    menu=[buttons(off, on, off), buttons(on, off)])  # -> flatten(Load)
loads_karamba_6 = LoadsKaramba(Vectors=unit_z_12, Mesh=mesh_38, LCase=0, mode="MeshLoad -Variable", menu=[buttons(on, off, off), buttons(on, off)])  # -> flatten(Load)
panel_9 = Panel(loads_karamba_5)
panel_10 = Panel(loads_karamba_4)
panel_11 = Panel(loads_karamba_6)
load_karamba_2 = LoadKaramba(flatten([loads_karamba_3, loads_karamba_4, loads_karamba_5, loads_karamba_6]))
weaverbird_s_mesh_edges_10 = WeaverbirdsMeshEdges(MeshOrPolylines=mesh_38)
length_5 = Length(Curve=weaverbird_s_mesh_edges_10)
maximum_4 = GhPythonScript(x=length_5)  # -> out, maxim, ind; inputs x: list; same code as maximum
max_beam_length = Number(maximum_4.maxim)

midpoint_6 = Midpoint(Curve=mesh_edges.NakedEdges)
expression_10 = Expression(x=flatten(deconstruct_6.ZComponent), Expression="if (x<.1,1,0)")
deconstruct_8 = Deconstruct(Point=midpoint_6)  # -> XComponent, YComponent, ZComponent
expression_11 = Expression(x=deconstruct_7.ZComponent, Expression="if (x<0.1,1,0)")
expression_12 = Expression(x=flatten(deconstruct_8.ZComponent), Expression="if (x<.05,1,0)")
cull_pattern_16 = CullPattern(List=mesh_edges.NakedEdges, CullPattern=invert(expression_12))  # -> flatten(List)
cull_pattern_17 = CullPattern(List=mesh_edges.NakedEdges, CullPattern=expression_12)  # -> flatten(List)
line_6 = Line(flatten(weaverbird_s_mesh_edges_9))
mesh_39 = Mesh(mesh_38)
max_member_length_m = Panel(max_beam_length)

mesh_40 = Mesh(mesh_35)
loads_karamba_7 = LoadsKaramba(
    Vector=unit_z_8,
    Mesh=mesh_40,
    BeamIdentifiers="A",
    LCase=0,
    mode="MeshLoad -Const.",
    menu=[buttons(off, on, off), buttons(on, off)])  # -> flatten(Load)
loads_karamba_8 = LoadsKaramba(
    Vector=unit_x_2,
    Mesh=mesh_40,
    BeamIdentifiers="A",
    LCase=0,
    mode="MeshLoad -Const.",
    menu=[buttons(off, off, on), buttons(on, off)])  # -> flatten(Load)
loads_karamba_9 = LoadsKaramba(
    Vector=unit_z_7,
    Mesh=mesh_40,
    BeamIdentifiers="A",
    LCase=0,
    mode="MeshLoad -Const.",
    menu=[buttons(off, on, off), buttons(on, off)])  # -> flatten(Load)
panel_12 = Panel(loads_karamba_8)
panel_13 = Panel(loads_karamba_9)
panel_14 = Panel(loads_karamba_7)
mesh_to_shell_karamba_2 = MeshToShellKaramba(Mesh=mesh_40, CrossSection=cross_sections_karamba_2, LimitDistance_m=0.005)  # -> Element, Points, Info
element_karamba_2 = ElementKaramba(flatten(mesh_to_shell_karamba_2.Element))
mesh_41 = Mesh(mesh_40)

weaverbird_s_naked_boundary_11 = WeaverbirdsNakedBoundary(MeshClosedPolylines=mesh_40)
explode_19 = Explode(Curve=weaverbird_s_naked_boundary_11, Recursive=True)  # -> Segments, Vertices
removeduplicatepts_15 = RemoveDuplicatePts(Points=explode_19.Vertices, Tolerance=Slider(0.01, range=0..0.01))
deconstruct_9 = Deconstruct(Point=removeduplicatepts_15)  # -> XComponent, YComponent, ZComponent
expression_13 = Expression(x=deconstruct_9.ZComponent, Expression="if (x<0.1,1,0)")
cull_pattern_18 = CullPattern(List=removeduplicatepts_15, CullPattern=expression_13)
load_karamba_3 = LoadKaramba(flatten([loads_karamba_2, loads_karamba_7, loads_karamba_9, loads_karamba_8]))

support_karamba_3 = SupportKaramba(PosInd=cull_pattern_18, menu=[buttons(on, on, on, on, on, on)])
support_karamba_4 = SupportKaramba(flatten(support_karamba_3))
assemble_model_karamba_2 = AssembleModelKaramba(
    Points=mesh_to_shell_karamba_2.Points,
    Elem=element_karamba_2,
    Support=support_karamba_4,
    Load=load_karamba_3,
    LimitDistance_m=0.005)  # -> Model, Info, Mass_kg, CenterOfGravity
analyzethi_karamba_2 = AnalyzeThIKaramba(Model=assemble_model_karamba_2.Model)  # -> CalculatedModel, MaximumDisplacement_m, ResultingForceOfGravity_kN, ElasticEnergy_kNm
panel_15 = Panel(analyzethi_karamba_2.MaximumDisplacement_m)
model_view_karamba_2 = ModelViewKaramba(Model=analyzethi_karamba_2.CalculatedModel, LoadCaseFactorsForLinearSuperposition=1, IndexOfVisibleLoadcase=-1)  # -> Model, DeformedMesh, DeformedAxes, DeformedModel
shell_view_karamba_2 = ShellViewKaramba(Model=model_view_karamba_2.Model, IndexOfLayer=0)  # -> Model, MeshesOfRenderedShells, LegendColors, LegendTags
legend_2 = Legend(Colour=shell_view_karamba_2.LegendColors, Tags=shell_view_karamba_2.LegendTags, LegendType=1)
calculated_model_4 = Data(shell_view_karamba_2.Model)

panel_16 = Panel(assemble_model_karamba_2.Mass_kg)

calculated_model_5 = Data(calculated_model_4)
mesh_42 = Mesh(mesh_41)
populate_geometry_4 = PopulateGeometry(Geometry=mesh_42, Count=number_slider_7, Seed=1)
line_results_on_shells_karamba_2 = LineResultsOnShellsKaramba(
    AnalyzedModel=calculated_model_5,
    Layer=Slider(0, range=-1..1),
    ListOfSourcesOfPrincipalStressLinesLinesPoints=populate_geometry_4,
    SegmentLength_m=0.1,
    DA_deg=90,
    mode="PrincStress")  # -> AnalyzedModel, Lines1, Lines2
custom_preview_6 = CustomPreview(Geometry=line_results_on_shells_karamba_2.Lines1, Shader=ColourSwatch(SwatchColor=RGB(63, 48, 210)))
custom_preview_7 = CustomPreview(Geometry=line_results_on_shells_karamba_2.Lines2, Shader=ColourSwatch(SwatchColor=RGB(211, 211, 0)))

cull_pattern_19 = CullPattern(List=weaverbird_s_mesh_edges_9, CullPattern=expression_10)  # -> flatten(List)
join_curves_3 = JoinCurves(Curves=cull_pattern_19, Preserve=False)  # -> flatten(Curves)
cull_pattern_20 = CullPattern(List=removeduplicatepts_14, CullPattern=expression_11)
ct11 = GhPythonScript(x=join_curves_3, z=mesh_edges.InteriorEdges)  # -> out, a, line; inputs x: list of Curve, z: list of Curve
# ---------- ct11: Python ----------
__author__ = "Gautam"
__version__ = "2019.03.24"
a=[]
line=[]
import rhinoscriptsyntax as rs
import ghpythonlib.treehelpers as gt
i=0
while i <len(z):
    count=0
    b=[]
    pointsz=rs.DivideCurve(z[i],2)
    zarray=rs.VectorCreate(pointsz[0],pointsz[2])
    for j in range(len(x)):
        inter=rs.CurveCurveIntersection(z[i],x[j],0.02)
        if inter!=None:

            pointsx=rs.DivideCurve(x[j],2)
            xarray=rs.VectorCreate(pointsx[0],pointsx[2])
            angle=rs.VectorAngle(zarray,xarray)
            if angle>45:
                a.append(z[i])
                count+=1

    if count<1:
        line.append(z[i])
    i+=1
a=gt.list_to_tree(a)
# ---------- end ct11 ----------
curve_24 = Curve(flatten([ct11.line, cull_pattern_17]))
curve_25 = Curve(flatten([cull_pattern_16, ct11.a]))
point_6 = Point(flatten(cull_pattern_20))
curve_26 = Curve(flatten(curve_25))
curve_27 = Curve(flatten(curve_24))
line_to_beam_karamba = LineToBeamKaramba(Line=curve_25, Identifier="A", CrossSection=cross_sections_karamba_4, New=True, Remove=True, LimitDistance_m=0.005)  # -> Element, Points, Info
line_to_beam_karamba_2 = LineToBeamKaramba(Line=curve_24, Identifier="A", CrossSection=cross_sections_karamba_3, New=True, Remove=True, LimitDistance_m=0.005)  # -> Element, Points, Info
support_karamba_5 = SupportKaramba(PosInd=point_6, menu=[buttons(on, on, on, on, on, on)])
element_karamba_3 = ElementKaramba(flatten([line_to_beam_karamba_2.Element, line_to_beam_karamba.Element]))
support_karamba_6 = SupportKaramba(flatten(support_karamba_5))
assemble_model_karamba_3 = AssembleModelKaramba(Elem=element_karamba_3, Support=support_karamba_6, Load=load_karamba_2, LimitDistance_m=0.005)  # -> Model, Info, Mass_kg, CenterOfGravity
analyzethii_karamba = AnalyzeThIIKaramba(Model=assemble_model_karamba_3.Model, LoadCase=-1, RTolerance=1, MaxIterations=50, NoTensionalNII=False)  # -> CalculatedModel, MaximumDisplacement_m, ResultingForceOfGravity_kN, ElasticEnergy_kNm
multiplication_20 = Multiplication(A=analyzethii_karamba.MaximumDisplacement_m, B=1000)
buckling_modes_karamba = BucklingModesKaramba(Model=analyzethii_karamba.CalculatedModel, FromIndex=1, NumberOfModes=1, MaximumNumberOfIterations=300, Epsilon=1e-07)  # -> ModelWithBucklingModesAsLoadCaseResults, BucklingLoadFactors
model_view_karamba_3 = ModelViewKaramba(Model=analyzethii_karamba.CalculatedModel, LoadCaseFactorsForLinearSuperposition=1, IndexOfVisibleLoadcase=-1)  # -> Model, DeformedMesh, DeformedAxes, DeformedModel
utilization_of_elements_karamba = UtilizationOfElementsKaramba(
    AnalyzedModel=analyzethii_karamba.CalculatedModel,
    LoadCase=-1,
    NumberOfSamplePoints=3,
    ElasticDesign=True,
    GammaM0=1,
    GammaM1=1,
    WithDetails=False,
    mode="Beams")  # -> AnalyzedModel, Utilization, SigMax_kN_cm2, SigMin_kN_cm2, TauMax_kN_cm2, UtilN, UtilVy, UtilVz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
data_2 = Data(utilization_of_elements_karamba.Utilization)
beam_view_karamba = BeamViewKaramba(Model=model_view_karamba_3.Model)  # -> Model, MeshesOfRenderedBeams, DeformedBeamAxes, LegendColors, LegendTags
maximum_5 = GhPythonScript(x=utilization_of_elements_karamba.Utilization)  # -> out, maxim, ind; inputs x: list; same code as maximum
panel_17 = Panel(maximum_5.ind)
legend_3 = Legend(Colour=beam_view_karamba.LegendColors, Tags=beam_view_karamba.LegendTags, LegendType=1)
bounds_2 = Bounds(Numbers=data_2)
deconstruct_domain²_2 = DeconstructDomain²(Domain=bounds_2)  # -> UMin, UMax, VMin, VMax
gradient_2 = Gradient(
    LowerLimit=Slider(0, range=0..1),
    UpperLimit=Slider(1, range=0..1),
    Parameter=data_2,
    stops=[0.0125: RGB(71, 206, 0), 0.561: RGB(242, 142, 0), 1: RGB(220, 0, 40)])
multiplication_21 = Multiplication(A=deconstruct_domain²_2.UMax, B=100)
buckling_load_factor = Number(buckling_modes_karamba.BucklingLoadFactors)
displacement_mm = Number(multiplication_20)
strain_energy = Number(analyzethii_karamba.ElasticEnergy_kNm)
mass_in_kg = Number(assemble_model_karamba_3.Mass_kg)
max_utilzation = Number(multiplication_21)

curve_28 = Curve(flatten([curve_27, curve_26]))
length_6 = Length(Curve=curve_28)

divide_curve_2 = DivideCurve(Curve=curve_26, Count=1, Kinks=False)  # -> Points, Tangents, Parameters
divide_curve_3 = DivideCurve(Curve=curve_27, Count=1, Kinks=False)  # -> Points, Tangents, Parameters
length_7 = Length(Curve=curve_26)
list_item_17 = ListItem(List=divide_curve_2.Points, Index=0, Wrap=True)  # -> flatten(Item)
list_item_18 = ListItem(List=divide_curve_3.Points, Index=0, Wrap=True)  # -> flatten(Item)
length_8 = Length(Curve=curve_27)
circle_cnr = CircleCNR(Center=list_item_17, Normal=curve_26, Radius=division)
circle_cnr_2 = CircleCNR(Center=list_item_18, Normal=curve_27, Radius=division_2)
vector = Vector(curve_26)
vector_2 = Vector(curve_27)
multiplication_22 = Multiplication(A=vector, B=length_7)
multiplication_23 = Multiplication(A=vector_2, B=length_8)
extrude = Extrude(Base=circle_cnr, Direction=multiplication_22)
extrude_2 = Extrude(Base=circle_cnr_2, Direction=multiplication_23)

surface = Surface([extrude_2, extrude])
list_item_19 = ListItem(List=surface, Index=panel_17, Wrap=True)
move_4 = Move(Geometry=surface, Motion=unit_x_3)  # -> Geometry, Transform
custom_preview_8 = CustomPreview(Geometry=move_4.Geometry, Shader=gradient_2)

move_5 = Move(Geometry=surface, Motion=unit_x)  # -> Geometry, Transform
bounds_3 = Bounds(Numbers=length_6)
deconstruct_domain²_3 = DeconstructDomain²(Domain=bounds_3)  # -> UMin, UMax, VMin, VMax
gradient_3 = Gradient(
    LowerLimit=deconstruct_domain²_3.UMin,
    UpperLimit=deconstruct_domain²_3.UMax,
    Parameter=length_6,
    stops=[0.0125: RGB(231, 248, 255), 0.503: RGB(102, 129, 242), 1: RGB(27, 16, 211)])
custom_preview_9 = CustomPreview(Geometry=move_5.Geometry, Shader=gradient_3)
max_utilization = Panel(max_utilzation)
buckling_load_factor_2 = Panel(buckling_load_factor)
strain_energy_knm = Panel(strain_energy)
displacement_mm_2 = Panel(displacement_mm)
mass_in_kg_2 = Panel(mass_in_kg)

colibri_parameters = ColibriParameters(
    planarity_deviation_mm=flatten(planarity_deviation_mm),
    max_member_length=flatten(max_member_length_m),
    Buckling_load_factor=flatten(buckling_load_factor_2),
    displacement_m=flatten(displacement_mm_2),
    max_utilization=flatten(max_utilization),
    mass_in_kg=flatten(mass_in_kg_2),
    Strain_energy_kNm=flatten(strain_energy_knm),
    No_of_nodes=flatten(no_of_nodes),
    Total_number_of_members=flatten(no_of_beams),
    Total_unique_members_After=flatten(no_of_unique_beams))
colibri_aggregator = ColibriAggregator(
    Folder="C:\Colibri\integrated",
    IterationGenomeID=colibri_iterator.Iteration_Genome,
    IterationPhenomeResults=colibri_parameters,
    ImgSetting=image_setting,
    _3DObjects=flatten([line_6, mesh_39]),
    Write=Toggle(True),
    recordingMode=2)

colibri_parameters_2 = ColibriParameters(
    planarity_deviation_mm=flatten(planarity_deviation_mm),
    max_member_length=flatten(max_member_length_m),
    Buckling_load_factor=flatten(buckling_load_factor_2),
    displacement_mm=flatten(displacement_mm_2),
    max_utilization=flatten(max_utilization),
    mass_in_kg=flatten(mass_in_kg_2),
    Strain_energy_kNm=flatten(strain_energy_knm),
    No_of_nodes=flatten(no_of_nodes),
    Total_number_of_members=flatten(no_of_beams),
    Total_unique_members_After=flatten(no_of_unique_beams))
colibri_aggregator_2 = ColibriAggregator(
    Folder="C:\Colibri\comparison",
    IterationGenomeID=colibri_iterator_2.Iteration_Genome,
    IterationPhenomeResults=colibri_parameters_2,
    ImgSetting=image_setting_2,
    _3DObjects=flatten([line_6, mesh_39]),
    Write=Toggle(False),
    recordingMode=0)

# ==== cluster CalculatingWindLoad
mesh = ClusterInput()

weaverbird_s_face_polylines = WeaverbirdsFacePolylines(Mesh=mesh)
explode = Explode(Curve=weaverbird_s_face_polylines, Recursive=True)  # -> Segments, Vertices
list_item = ListItem(List=explode.Vertices, Index=0, Wrap=True)  # -> Item, Item1, Item2, Item3
_4point_surface = _4PointSurface(CornerA=list_item.Item, CornerB=list_item.Item1, CornerC=list_item.Item2, CornerD=list_item.Item3)
area = Area(Geometry=_4point_surface)  # -> Area, flatten(Centroid)
deconstruct = Deconstruct(Point=area.Centroid)  # -> XComponent, YComponent, flatten(ZComponent)
maximum = GhPythonScript(x=deconstruct.XComponent)  # -> out, maxim, ind; inputs x: list
# ---------- maximum: Python ----------
__author__ = "Gautam"
__version__ = "2019.03.04"

import rhinoscriptsyntax as rs
maxim=max(x)
ind=x.index(maxim)
# ---------- end maximum ----------
maximum_2 = GhPythonScript(x=deconstruct.XComponent)  # -> out, minim, ind; inputs x: list
# ---------- maximum_2: Python ----------
__author__ = "Gautam"
__version__ = "2019.03.04"

import rhinoscriptsyntax as rs
minim=min(x)
ind=x.index(minim)
# ---------- end maximum_2 ----------
deconstruct_2 = Deconstruct(Point=area.Centroid)  # -> XComponent, YComponent, ZComponent
list_item_2 = ListItem(List=area.Centroid, Index=maximum.ind, Wrap=True)
list_item_3 = ListItem(List=area.Centroid, Index=maximum_2.ind, Wrap=True)
construct_point = ConstructPoint(XCoordinate=deconstruct_2.XComponent, YCoordinate=0, ZCoordinate=0)
deconstruct_3 = Deconstruct(Point=list_item_3)  # -> XComponent, YComponent, ZComponent
deconstruct_4 = Deconstruct(Point=list_item_2)  # -> XComponent, YComponent, ZComponent
construct_point_2 = ConstructPoint(XCoordinate=deconstruct_4.XComponent, YCoordinate=0, ZCoordinate=0)
construct_point_3 = ConstructPoint(XCoordinate=deconstruct_3.XComponent, YCoordinate=0, ZCoordinate=0)
line = Line(StartPoint=construct_point_2, EndPoint=construct_point_3)  # -> flatten(Line)
divide_curve = DivideCurve(Curve=line, Count=6, Kinks=False)  # -> flatten(Points), Tangents, Parameters
panel = Panel("""0.9
0
-.6
-.9
-.6
-.3
0""")
unit_y = UnitY(Factor=panel)
move = Move(Geometry=divide_curve.Points, Motion=unit_y)  # -> Geometry, Transform
polyline = PolyLine(Vertices=move.Geometry, Closed=False)
curve_closest_point = CurveClosestPoint(Point=construct_point, Curve=polyline)  # -> Point, Parameter, Distance
xz_plane = XZPlane(Origin=Point(0, 0, 0))
point_plane_side = PointPlaneSide(Point=curve_closest_point.Point, Plane=xz_plane)  # -> Side, Front, Back, Distance
expression = Expression(x=point_plane_side.Back, Expression="if (x=True,1,-1)")
multiplication = Multiplication(A=curve_closest_point.Distance, B=expression)

result = ClusterOutput(multiplication)
